# Grasshopper definition planar_slicing_master.gh (Grasshopper 1.0.7)

data_folder_name = Panel("data")

# ---- group: Folder name
# Output
# Input
data = Data(data_folder_name)

# ---- group: Path cross-section
xz = XZPlane(Origin=Point(0, 0, 0))
rectangle = Rectangle(Plane=xz, XSize=Slider(2.5, range=0..10), YSize=Slider(1, range=0..10), Radius=Slider(0.43, range=0..1))  # -> Rectangle, Length

# ---- group: Cutting shape
crv = Curve(<curve referenced from the Rhino model>)
Z = UnitZ(Factor=Slider(245, range=0..1000))
extr = Extrude(Base=crv, Direction=Z)
cap = CapHoles(Brep=extr)

# ----
number_slider = Slider(91, range=0..1000)
Z_2 = UnitZ(Factor=1)
X = UnitX(Factor=1)
neg = Negative(Value=Z_2)
# Load Print points
button = Button()

# ----
# Load Slicer
panel = Panel("slicer_data.json")
py = PythonScript()  # -> path
# ---------- py: Python ----------
import sys
import os

ghComp = ghenv.Component
ghDoc = ghComp.OnPingDocument()

# the full path of the gh file
path = ghDoc.FilePath
# the current directory 
path = os.path.abspath(os.path.join(path, ".."))

print path
# ---------- end py ----------
load_print_points = GhPythonScript(recompute=button, path=py, folder_name=data, name="out_printpoints.json")  # -> out, geometry, points, frames, layer_heights, up_vectors, mesh_normals, closest_support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
# ---------- load_print_points: Python ----------
import os
import json
import rhinoscriptsyntax as rs
import Rhino.Geometry as rg
from compas.geometry import Frame

filename =os.path.join(os.path.join(path), folder_name , 'output', name)
print(filename)

# load data from json
with open(filename, 'r') as f:
    data = json.load(f)
print("Loaded Json: " + filename)

# geometry related data
points = []
frames = []
layer_heights = []
up_vectors = []
mesh_normals = []
closest_support = []

# fabrication related data
velocities = []
wait_times = []
blend_radiuses = []
extruder_toggles = []
feasibility = []


for i in range(len(data)):
    data_point = data[str(i)]
    
    # geometry related data
    point = rg.Point3d(data_point["point"][0], data_point["point"][1], data_point["point"][2])
    points.append(point)
    
    compas_frame = Frame.from_data(data_point["frame"])
    pt, x_axis, y_axis = compas_frame.point, compas_frame.xaxis, compas_frame.yaxis
    frame = rs.PlaneFromNormal(pt, rs.VectorCrossProduct(rg.Vector3d(x_axis[0], x_axis[1], x_axis[2]), rg.Vector3d(y_axis[0], y_axis[1], y_axis[2])))
    frames.append(frame)
    
    layer_height = data_point["layer_height"]
    layer_heights.append(layer_height)
    
    v = data_point["up_vector"]
    up_vector = rg.Vector3d(v[0], v[1], v[2])
    up_vectors.append(up_vector)
    
    v = data_point["mesh_normal"]
    mesh_normal = rg.Vector3d(v[0], v[1], v[2])
    mesh_normals.append(mesh_normal)
    
    cp = data_point["closest_support_pt"]
    if cp:
        cp_pt = rg.Point3d(cp[0], cp[1], cp[2])
        closest_support.append(cp_pt)
    
    # fabrication related data
    velocities.append(data_point["velocity"])
    wait_times.append(data_point["wait_time"])
    blend_radiuses.append(data_point["blend_radius"])
    extruder_toggles.append(data_point["extruder_toggle"])
    feasibility.append(data_point["is_feasible"])
    

# create full polyline
continuous_path_polyline = rs.AddPolyline(points)
# ---------- end load_print_points ----------
load_slicer_data = GhPythonScript(recompute=Button(), path=py, folder_name=data, name=panel)  # -> out, paths, all_points, mesh
# ---------- load_slicer_data: Python ----------
import os
import json
import rhinoscriptsyntax as rs
from compas.datastructures import Mesh
import Rhino.Geometry as rg
from compas_ghpython.artists import MeshArtist

filename =os.path.join(os.path.join(path), folder_name , 'output', name)
print(filename)
data = None

# load data from json
try:
    with open(filename, 'r') as f:
        data = json.load(f)
    print("Loaded Json: " + filename)
except:
    print('Attention! "' + filename + '"  does not exist')

paths = []
all_points = []
    
if data:
    if 'mesh' in data:
        compas_mesh = Mesh.from_data(data['mesh'])
        artist = MeshArtist(compas_mesh)
        mesh = artist.draw()
#        vs, fi = compas_mesh.to_vertices_and_faces()
#        mesh = rg.Mesh()
#        for f in fi:
#            gh_face = rg.MeshFace(f[0], f[1], f[2])
#            mesh.Faces.AddFace(gh_face)
#        for v in vs:
#            pt = rg.Point3d(v[0], v[1], v[2])
#            mesh.Vertices.Add(pt)
    
        
    if 'layers' in data:
        layers_data = data['layers']
    
        for i in range(len(layers_data)):
            layer_data = layers_data[str(i)]
            paths_data = layer_data['paths']
            for j in range(len(paths_data)):
                path_data = paths_data[str(j)]
                pts = []
    
                for k in range(len(path_data['points'])):
                    pt = path_data['points'][str(k)]
                    # re-create points
                    pt = rs.AddPoint(pt[0], pt[1], pt[2])
                    pts.append(pt)
                all_points.extend(pts)
                
                # create contour per layer
                try:
                    path = rs.AddPolyline(pts)
                except:
                    print('Attention! Could not add polyline at layer %d, path %d with %d points ' % (i, j, len(path_data['points'])))
                paths.append(path)
# ---------- end load_slicer_data ----------

Z_3 = UnitZ(Factor=1)
X_2 = UnitX(Factor=1)
Z_4 = UnitZ(Factor=1)

pt = Point(load_slicer_data.all_points)
mesh = Mesh(load_slicer_data.mesh)
crv_2 = Curve(load_slicer_data.paths)

# ----
# Tool Visualization
# Note: This is only an example. The actual tool orientation depends on the definition of the frame of your tool
pt_2 = Point(pt)

mesh_normals = Vector(load_print_points.mesh_normals)
section = Curve(rectangle.Rectangle)  # disabled
# Heavy path visualization
points = Point(pt)  # disabled

pl = ConstructPlane(Origin=pt_2, XAxis=neg, YAxis=X)

print_planes = Plane(pl)
tool_mesh = Mesh(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)

# ---- group: Visualize mesh printing path
# Visualization
# Ligthweight path visualization
list = ValueList({"Visualize full path": 0, "Visualize part of path (set domain)": 1}, selected="Visualize full path")
sgements_resolution = Slider(14, range=0..20)
nozzle_diameter = Slider(1.5, range=0..10)
dom = ConstructDomain(DomainStart=Slider(0, range=0..100), DomainEnd=Slider(439, range=0..500))
subset = SubList(List=pt, Domain=dom, Wrap=True)  # -> List, Index
subset_2 = SubList(List=load_print_points.blend_radiuses, Domain=dom, Wrap=True)  # -> List, Index
filter = StreamFilter(Gate=list, Stream0=pt, Stream1=subset.List)
filter_2 = StreamFilter(Gate=list, Stream0=load_print_points.blend_radiuses, Stream1=subset_2.List)
python = GhPythonScript(points=filter, extruder_toggle_list=filter_2, nozzle_diameter=nozzle_diameter, segments=sgements_resolution)  # -> out, print_path_pipes, travel_path_lines; inputs points: list of Point3d, extruder_toggle_list: list
# ---------- python: Python ----------
__author__ = "joburger"
__version__ = "2020.10.12"

import Rhino.Geometry as rg

print_path_pipes = []
travel_path_lines = []

for i in range(len(points)-1):
    if extruder_toggle_list[i] == True:
        # if extruder_toggle is true, create line
        line = rg.Curve.CreateControlPointCurve([points[i], points[i+1]])
        # create meshpipe and append
        pipe = rg.Mesh.CreateFromCurvePipe(line, nozzle_diameter/2, segments, 1, rg.MeshPipeCapStyle.None, True)
        print_path_pipes.append(pipe)
    else:
        # if extruder_toggle is false, add to travel path list
        line = rg.Curve.CreateControlPointCurve([points[i], points[i+1]])
        travel_path_lines.append(line)
# ---------- end python ----------
geo = Geometry(python.travel_path_lines)
geo_2 = Geometry(python.print_path_pipes)
preview = CustomPreview(Geometry=geo_2, Material=ColourSwatch(SwatchColor=RGB(130, 130, 130)))
preview_2 = CustomPreview(Geometry=geo, Material=ColourSwatch(SwatchColor=RGB(255, 156, 36)))

# ----
pl_2 = ConstructPlane(Origin=points, XAxis=mesh_normals, YAxis=Z_3)
deplane = DeconstructPlane(Plane=print_planes)  # -> Origin, XAxis, YAxis, ZAxis

points_2 = Point(load_print_points.points)
frames = Plane(load_print_points.frames)
up_vectors = Vector(load_print_points.up_vectors)
mesh_normals_2 = Vector(load_print_points.mesh_normals)
cpts = Point(load_print_points.closest_support)
layer_heights = Number(load_print_points.layer_heights)

# ---- group: up vectors
up_vector = UnitVector(Vector=up_vectors)  # disabled

# ---- group: layer heights
num = Number(layer_heights)  # disabled

# ----
multiplication = Multiplication(A=num, B=Slider(0.9, range=0..1))

# ---- group: Customize section
section_2 = Curve(section)
area = Area(Geometry=section_2)  # -> Area, Centroid
scale_nu = ScaleNU(Geometry=section_2, Plane=area.Centroid, ScaleX=multiplication, ScaleY=1, ScaleZ=multiplication)  # -> Geometry, Transform

# ----
pl_3 = ConstructPlane(Origin=area.Centroid, XAxis=X_2, YAxis=Z_4)

wait_times = Number(load_print_points.wait_times)
extruder_toggles = Number(load_print_points.extruder_toggles)
feasibility = Boolean(load_print_points.feasibility)
velocities = Number(load_print_points.velocities)
blend_radiuses = Number(load_print_points.blend_radiuses)

orient = Orient(Geometry=scale_nu.Geometry, Source=pl_3, Target=pl_2)  # -> flatten(Geometry), Transform
tool_origin_only_for_visualization = Panel("""0.153792
-0.01069
-0.045507""")

# ---- group: tool visualization
# Tool visualization
button_2 = Button()
python_2 = PythonScript(
    recompute=button_2,
    origin_coords=tool_origin_only_for_visualization,
    mesh=tool_mesh,
    planes=print_planes,
    i=number_slider)  # -> tool, mesh; inputs origin_coords: list, mesh: Mesh, planes: list of Plane, i: Int32
# ---------- python_2: Python ----------
import os
from compas.geometry import Frame
from compas.datastructures import Mesh
from compas_ghpython.artists import MeshArtist

import Rhino.Geometry as rg
import rhinoscriptsyntax as rs

origin = [float(origin_coords[0]), float(origin_coords[1]) , float(origin_coords[2])]
o = rg.Point3d(origin[0], origin[1], origin[2])
xaxis = [1, 0, 0]
x = rg.Vector3d(1, 0, 0)
yaxis = [0, 1, 0]
y = rg.Vector3d(0, 1, 0)

ee_frame = rg.Plane(o,x,y)
target_frame = planes[i]

T = rg.Transform.PlaneToPlane(ee_frame, target_frame)
S = rg.Transform.Scale(target_frame, 1000, 1000, 1000)

#rs.CopyObject(mesh)
mesh = rs.TransformObject(rs.CopyObject(mesh), T)
mesh = rs.TransformObject(rs.CopyObject(mesh), S)
# ---------- end python_2 ----------
mesh_2 = Mesh(python_2.mesh)
preview_3 = CustomPreview(Geometry=mesh_2, Material=ColourSwatch(SwatchColor=RGB(171, 171, 171)))

# ---- group: Path visualization
series = Series(Start=0, Step=1, Count=expr("x+1", number_slider))
item = ListItem(List=deplane.Origin, Index=series, Wrap=True)
pline = PolyLine(Vertices=item, Closed=False)

# ---- group: Select parameter
num_2 = Number(extruder_toggles)

# ----
shift = ShiftList(List=orient.Geometry, Shift=1, Wrap=False)  # -> graft(List)
curvepoint = PointOnCurve(crv_2, parameter=0)
disc = Discontinuity(Curve=crv_2, Level=1)  # -> Points, Parameters
end = EndPoints(Curve=crv_2)  # -> Start, End
preview_4 = CustomPreview(Geometry=crv_2, Material=ColourSwatch(SwatchColor=RGB(189, 189, 189)))
data_2 = Data(simplify(graft(shift)))
data_3 = Data(simplify(graft(orient.Geometry)))

# ---- group: Visualize section of print path
dom_2 = ConstructDomain(DomainStart=Slider(0, range=0..100), DomainEnd=Slider(151, range=0..500))
subset_3 = SubList(List=points_2, Domain=dom_2, Wrap=True)  # -> List, Index
pline_2 = PolyLine(Vertices=subset_3.List, Closed=False)

# ---- group: Visualize with text
tag_offset = Slider(1, range=0..100)
pdecon = Deconstruct(Point=points_2)  # -> XComponent, YComponent, ZComponent
addition = Addition(A=pdecon.ZComponent, B=tag_offset)
pt_3 = ConstructPoint(XCoordinate=pdecon.XComponent, YCoordinate=pdecon.YComponent, ZCoordinate=addition)
tag = TextTag(Location=pt_3, Text=num_2, Colour=ColourSwatch(SwatchColor=RGB(50, 130, 186)))

# ---- group: Visualize in color
bnd = Bounds(Numbers=num_2)
dedomain = DeconstructDomain(Domain=bnd)  # -> Start, End
gradient = Gradient(
    LowerLimit=dedomain.Start,
    UpperLimit=dedomain.End,
    Parameter=num_2,
    stops=[0: RGB(0, 128, 0), 0.5: RGB(255, 255, 0), 1: RGB(255, 0, 0)])
pt_4 = Point(load_print_points.points)
cloud = CloudDisplay(Points=pt_4, Colours=gradient, Size=Slider(2.28, range=0..10), SpriteType=0)

# ----
loft = Loft(
    Curves=[data_3, data_2],
    Options={Adjust=False, Closed=False, LoftEnds=0, LoftSimp=0, LoftType=0, Rebuild=10, Refit=0.01})  # -> flatten(Loft)

# ---- group: find duplicate pts
pt_5 = Point(pt)
cullpt = CullDuplicates(Points=pt_5, Tolerance="0.0001", CullMode=3)  # -> Points, Indices, Valence
python_3 = GhPythonScript(x=cullpt.Valence)  # -> out, a; inputs x: list
# ---------- python_3: Python ----------
__author__ = "Ioanna"
__version__ = "2020.10.19"

import rhinoscriptsyntax as rs  

a=[]
for i, v in enumerate(x):
    if v == 2:
        a.append(i)
# ---------- end python_3 ----------
item_2 = ListItem(List=pt_5, Index=python_3.a, Wrap=True)

# ---- group: Load points from json
py_2 = PythonScript()  # -> path; same code as py
# Helpers
load_points = GhPythonScript(recompute=Button(), path=py_2, folder_name=py, name="debug_pts.json")  # -> out, pts
# ---------- load_points: Python ----------
import os
import json
import rhinoscriptsyntax as rs
from compas.datastructures import Mesh
import Rhino.Geometry as rg

filename =os.path.join(os.path.join(path), folder_name , 'output', name)
print(filename)
data = None

# load data from json
try:
    with open(filename, 'r') as f:
        data = json.load(f)
    print("Loaded Json: " + filename)
except:
    print('Attention! "' + filename + '"  does not exist')


if data:
    pts = []
    for p in data:
        pts.append(rg.Point3d(p[0], p[1], p[2]))
# ---------- end load_points ----------

# ----
null = NullItem(Item=loft)  # -> NullFlags, InvalidFlags, Description
demesh = DeconstructMesh(Mesh=mesh)  # -> Vertices, Faces, Colours, Normals
dispatch = Dispatch(List=loft, DispatchPattern=null.NullFlags)  # -> ListA, ListB
python_4 = GhPythonScript(pts=demesh.Vertices)  # -> out, lines; inputs pts: list of Point3d
# ---------- python_4: Python ----------
__author__ = "Ioanna"
__version__ = "2020.10.28"

import rhinoscriptsyntax as rs 

input = [(9600, 9700), (9600, 9799), (9601, 9701), (9601, 9700), (9602, 9702), (9602, 9701), (9602, 9703), (9603, 9703), (9604, 9704), (9604, 9703), (9605, 9705), (9605, 9704), (9606, 9706), (9606, 9705), (9606, 9707), (9607, 9707), (9608, 9708), (9608, 9707), (9609, 9709), (9609, 9708), (9610,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

lines = []
print(len(input))

for edge in input:
    lines.append(rs.AddLine(pts[edge[0]], pts[edge[1]]))
# ---------- end python_4 ----------

item_3 = ListItem(List=demesh.Vertices, Index=Slider(9600, range=0..10000), Wrap=True)
item_4 = ListItem(List=demesh.Vertices, Index=Slider(9700, range=0..10000), Wrap=True)
ln = Line(StartPoint=item_3, EndPoint=item_4)

item_5 = ListItem(List=demesh.Vertices, Index=Slider(9600, range=0..10000), Wrap=True)
item_6 = ListItem(List=demesh.Vertices, Index=Slider(9799, range=0..10000), Wrap=True)
ln_2 = Line(StartPoint=item_5, EndPoint=item_6)

item_7 = ListItem(List=demesh.Vertices, Index=Slider(9601, range=0..10000), Wrap=True)
item_8 = ListItem(List=demesh.Vertices, Index=Slider(9701, range=0..10000), Wrap=True)
ln_3 = Line(StartPoint=item_7, EndPoint=item_8)

brep = Brep(dispatch.ListB)

swatch = ColourSwatch(SwatchColor=RGB(176, 176, 176))
preview_5 = CustomPreview(Geometry=brep, Material=swatch)
number_slider_2 = Slider(3, range=0..10)

# ---- group: Triangle mesh
input_mesh = Mesh(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)

# ----
contour = Contour(Shape=input_mesh, Point=Point(0, 0, 0), Direction=Vector(0, 0, 1), Distance=number_slider_2)

# ---- group: Layers
geo_3 = Geometry(flatten(contour))

# ----
# Save to json
# Enables loading ready - made paths in compas_slicer.
# You need to provide the gh_paths and the gh_mesh
panel_2 = Panel("paths_from_gh.json")
py_3 = PythonScript()  # -> path; same code as py
save_paths_to_json = GhPythonScript(
    recompute=Button(),
    gh_layers=geo_3,
    gh_mesh=input_mesh,
    gh_layer_height=number_slider_2,
    save_Json=Toggle(True),
    path=py_3,
    folder_name=data,
    output_name=panel_2)  # -> out, paths, all_points, mesh; inputs gh_layers: list of Curve, gh_mesh: Mesh, save_Json: Boolean
# ---------- save_paths_to_json: Python ----------
import os
import json
import rhinoscriptsyntax as rs
import Rhino.Geometry as rg
from compas.datastructures import Mesh

def save_to_json(data, filepath, name):
    filename = os.path.join(filepath, 'output', name)
    print("Saving to json: " + filename)
    with open(filename, 'w') as f:
        f.write(json.dumps(data, indent=3, sort_keys=True))


data = {}

########## Export mesh
## Need to check that it is triangular 
vs = gh_mesh.Vertices
vs = [[float(v.X), float(v.Y), float(v.Z)]for v in vs]
fi = gh_mesh.Faces
fi = [[int(f.A), int(f.B), int(f.C)]for f in fi]

compas_mesh = Mesh.from_vertices_and_faces(vs,fi)
data['mesh'] = dict(compas_mesh.to_data())

########## Export paths
data['layers'] = {}
data['layer_height'] = gh_layer_height

for i, gh_layer in enumerate(gh_layers):
    data['layers']['layer_%d' % i] = {}
    data['layers']['layer_%d' % i]['path_0'] = {}
    data['layers']['layer_%d' % i]['path_0']['points'] = [[pt.X, pt.Y, pt.Z] for pt in rs.CurvePoints(gh_layer)]
    data['layers']['layer_%d' % i]['path_0']['is_closed'] = True
    
    
if save_Json:
    save_to_json(data, os.path.join(path, folder_name), output_name)
# ---------- end save_paths_to_json ----------

# ---- group: Cut to display object section
cap_2 = CapHoles(Brep=dispatch.ListB)  # disabled
cutter = Geometry(cap)  # disabled

# ----
null_2 = NullItem(Item=cap_2)  # -> NullFlags, InvalidFlags, Description; disabled
dispatch_2 = Dispatch(List=cap_2, DispatchPattern=null_2.NullFlags)  # -> ListA, ListB; disabled

# ---- group: Cut to display object section (continued)
sdiff = SolidDifference(BrepsA=flatten(dispatch_2.ListB), BrepsB=cutter)  # disabled
cap_3 = CapHoles(Brep=sdiff)  # disabled
shapein = ShapeInBrep(Brep=cutter, Shape=cap_3)  # disabled
dispatch_3 = Dispatch(List=sdiff, DispatchPattern=shapein)  # -> ListA, ListB; disabled

# ---- group: Sections
mesh_3 = Mesh(dispatch_3.ListA)  # disabled
mesh_4 = Mesh(dispatch_3.ListB)  # disabled

# ----
preview_6 = CustomPreview(Geometry=mesh_3, Material=swatch)  # disabled
