# Grasshopper definition visualization.gh (Grasshopper 1.0.7)

py = PythonScript()  # -> path
# ---------- py: Python ----------
import sys
import os

ghComp = ghenv.Component
ghDoc = ghComp.OnPingDocument()

# the full path of the gh file
path = ghDoc.FilePath
# the current directory 
path = os.path.abspath(os.path.join(path, ".."))

print path
# ---------- end py ----------

py_2 = PythonScript()  # -> path; same code as py
slicer_data = GhPythonScript(recompute=Button(), path=py_2, folder="data", name="slicer_data.json")  # -> out, paths, all_points, mesh
# ---------- slicer_data: Python ----------
import os
import json
import rhinoscriptsyntax as rs
from compas.datastructures import Mesh

filename =os.path.join(os.path.join(path), folder ,name)
print(filename)

# load data from json
with open(filename, 'r') as f:
    data = json.load(f)
print("Loaded Json: " + filename)

paths = []
all_points = []

if 'mesh' in data:
    mesh = Mesh.from_data(data['mesh'])
    ## find how to turn Compas Mesh to Rhino mesh
    
if 'layers' in data:
    layers = data['layers']

    for i in range(len(layers)):
        layer = layers[str(i)]
        for j in range(len(layer)):
            path_data = layer[str(j)]
            pts = []

            for k in range(len(path_data['points'])):
                pt = path_data['points'][str(k)]
                # re-create points
                pt = rs.AddPoint(pt[0], pt[1], pt[2])
                pts.append(pt)
            all_points.extend(pts)
            
            # create contour per layer
            path = rs.AddPolyline(pts)
            paths.append(path)
# ---------- end slicer_data ----------

slicer_data_2 = GhPythonScript(recompute=Button(), path=py, folder="data", name="fabrication_commands.json")  # -> out, points, planes, continuous_path_polyline, velocity_list, radius_list, wait_time_list, extruder_toggle_list
# ---------- slicer_data_2: Python ----------
import os
import json
import rhinoscriptsyntax as rs

filename =os.path.join(os.path.join(path), folder ,name)
print(filename)

# load data from json
with open(filename, 'r') as f:
    data = json.load(f)
print("Loaded Json: " + filename)

points = []
planes = []
velocity_list = []
radius_list = []
wait_time_list = []
extruder_toggle_list = []

for i in range(len(data)):
    data_point = data[str(i)]
    x = data_point["x"]
    y = data_point["y"]
    z = data_point["z"]
    ax = data_point["ax"]
    ay = data_point["ay"]
    az = data_point["az"]
    velocity = data_point["velocity"]
    radius = data_point["radius"]
    wait_time = data_point["wait_time"]
    extruder_toggle = data_point["extruder_toggle"]
    
    # re-create points
    point = rs.AddPoint(x, y, z)
    points.append(point)
    
    # re-create planes
    # not sure if planes are in the correct orientation?
    plane = rs.PlaneFromNormal(point, (ax, ay, az))
    planes.append(plane)
    
    velocity_list.append(velocity)
    radius_list.append(radius)
    wait_time_list.append(wait_time)
    extruder_toggle_list.append(extruder_toggle)

# create full polyline
continuous_path_polyline = rs.AddPolyline(points)
# ---------- end slicer_data_2 ----------
pt = Point(slicer_data_2.points)
pln = Plane(slicer_data_2.planes)
crv = Curve(slicer_data_2.continuous_path_polyline)

# ---- group: Visualize printing parameters
# Select parameter to visualize
list = ValueList({"Velocity": 0, "Radius": 1, "Wait time": 2, "Extruder toggle": 3}, selected="Velocity")
tag_offset = Slider(1, range=0..100)
pdecon = Deconstruct(Point=pt)  # -> XComponent, YComponent, ZComponent
filter = StreamFilter(
    Gate=list,
    Stream0=slicer_data_2.velocity_list,
    Stream1=slicer_data_2.radius_list,
    Stream2=slicer_data_2.wait_time_list,
    Stream3=slicer_data_2.extruder_toggle_list)
addition = Addition(A=pdecon.ZComponent, B=tag_offset)
pt_2 = ConstructPoint(XCoordinate=pdecon.XComponent, YCoordinate=pdecon.YComponent, ZCoordinate=addition)
tag = TextTag(Location=pt_2, Text=filter, Colour=ColourSwatch(SwatchColor=RGB(50, 130, 186)))

# ---- group: Visualize section of print path
dom = ConstructDomain(DomainStart=Slider(0, range=0..100), DomainEnd=Slider(251, range=0..500))
subset = SubList(List=pt, Domain=dom, Wrap=True)  # -> List, Index
pline = PolyLine(Vertices=subset.List, Closed=False)

# ----
pt_3 = Point(slicer_data.all_points)
crv_2 = Curve(slicer_data.paths)
curvepoint = PointOnCurve(crv_2, parameter=1)
disc = Discontinuity(Curve=crv_2, Level=1)  # -> Points, Parameters
end = EndPoints(Curve=crv_2)  # -> Start, End
item = ListItem(List=crv_2, Index=0, Wrap=True)
preview = CustomPreview(Geometry=crv_2, Material=ColourSwatch(SwatchColor=RGB(189, 189, 189)))
