# Grasshopper definition visualization_master.gh (Grasshopper 1.0.7)

data_folder_name = Panel("data")

# ----
# Visualize robotic commands
# Visualize robotic commands and their parameters
panel = Panel("fabrication_commands.json")
py = PythonScript()  # -> path
# ---------- py: Python ----------
import sys
import os

ghComp = ghenv.Component
ghDoc = ghComp.OnPingDocument()

# the full path of the gh file
path = ghDoc.FilePath
# the current directory 
path = os.path.abspath(os.path.join(path, ".."))

print path
# ---------- end py ----------
load_fabrication_commands = GhPythonScript(recompute=Button(), path=py, folder_name=data_folder_name, name=panel)  # -> out, points, planes, continuous_path_polyline, velocity_list, radius_list, wait_time_list, extruder_toggle_list
# ---------- load_fabrication_commands: Python ----------
import os
import json
import rhinoscriptsyntax as rs

filename =os.path.join(os.path.join(path), folder_name ,name)
print(filename)

# load data from json
with open(filename, 'r') as f:
    data = json.load(f)
print("Loaded Json: " + filename)

points = []
planes = []
velocity_list = []
radius_list = []
wait_time_list = []
extruder_toggle_list = []

for i in range(len(data)):
    data_point = data[str(i)]
    x = data_point["x"]
    y = data_point["y"]
    z = data_point["z"]
    ax = data_point["ax"]
    ay = data_point["ay"]
    az = data_point["az"]
    velocity = data_point["velocity"]
    radius = data_point["radius"]
    wait_time = data_point["wait_time"]
    extruder_toggle = data_point["extruder_toggle"]
    
    # re-create points
    point = rs.AddPoint(x, y, z)
    points.append(point)
    
    # re-create planes
    # not sure if planes are in the correct orientation?
    plane = rs.PlaneFromNormal(point, (ax, ay, az))
    planes.append(plane)
    
    velocity_list.append(velocity)
    radius_list.append(radius)
    wait_time_list.append(wait_time)
    extruder_toggle_list.append(extruder_toggle)

# create full polyline
continuous_path_polyline = rs.AddPolyline(points)
# ---------- end load_fabrication_commands ----------

# ----
# Visualize slicer
# Visualize paths and mesh of slicer
panel_2 = Panel("slicer_data.json")
py_2 = PythonScript()  # -> path; same code as py
load_slicer_data = GhPythonScript(recompute=Button(), path=py_2, folder_name=data_folder_name, name=panel_2)  # -> out, paths, all_points, mesh
# ---------- load_slicer_data: Python ----------
import os
import json
import rhinoscriptsyntax as rs
from compas.datastructures import Mesh
import Rhino.Geometry as rg

filename =os.path.join(os.path.join(path), folder_name ,name)
print(filename)

# load data from json
with open(filename, 'r') as f:
    data = json.load(f)
print("Loaded Json: " + filename)

paths = []
all_points = []

if 'mesh' in data:
    compas_mesh = Mesh.from_data(data['mesh'])
    vs, fi = compas_mesh.to_vertices_and_faces()
    mesh = rg.Mesh()
    for f in fi:
        gh_face = rg.MeshFace(f[0], f[1], f[2])
        mesh.Faces.AddFace(gh_face)
    for v in vs:
        pt = rg.Point3d(v[0], v[1], v[2])
        mesh.Vertices.Add(pt)

    
if 'layers' in data:
    layers = data['layers']

    for i in range(len(layers)):
        layer = layers[str(i)]
        for j in range(len(layer)):
            path_data = layer[str(j)]
            pts = []

            for k in range(len(path_data['points'])):
                pt = path_data['points'][str(k)]
                # re-create points
                pt = rs.AddPoint(pt[0], pt[1], pt[2])
                pts.append(pt)
            all_points.extend(pts)
            
            # create contour per layer
            path = rs.AddPolyline(pts)
            paths.append(path)
# ---------- end load_slicer_data ----------

pt = Point(load_fabrication_commands.points)

# ---- group: Visualize mesh printing path
list = ValueList({"Visualize full path": 0, "Visualize part of path (set domain)": 1}, selected="Visualize full path")
nozzle_diameter = Slider(1.5, range=0..10)
sgements_resolution = Slider(14, range=0..20)
dom = ConstructDomain(DomainStart=Slider(0, range=0..100), DomainEnd=Slider(439, range=0..500))
subset = SubList(List=pt, Domain=dom, Wrap=True)  # -> List, Index
subset_2 = SubList(List=load_fabrication_commands.extruder_toggle_list, Domain=dom, Wrap=True)  # -> List, Index
filter = StreamFilter(Gate=list, Stream0=pt, Stream1=subset.List)
filter_2 = StreamFilter(Gate=list, Stream0=load_fabrication_commands.extruder_toggle_list, Stream1=subset_2.List)
python = GhPythonScript(points=filter, extruder_toggle_list=filter_2, nozzle_diameter=nozzle_diameter, segments=sgements_resolution)  # -> out, print_path_pipes, travel_path_lines; inputs points: list of Point3d, extruder_toggle_list: list
# ---------- python: Python ----------
__author__ = "joburger"
__version__ = "2020.10.12"

import Rhino.Geometry as rg

print_path_pipes = []
travel_path_lines = []

for i in range(len(points)-1):
    if extruder_toggle_list[i] == True:
        # if extruder_toggle is true, create line
        line = rg.Curve.CreateControlPointCurve([points[i], points[i+1]])
        # create meshpipe and append
        pipe = rg.Mesh.CreateFromCurvePipe(line, nozzle_diameter/2, segments, 1, rg.MeshPipeCapStyle.None, True)
        print_path_pipes.append(pipe)
    else:
        # if extruder_toggle is false, add to travel path list
        line = rg.Curve.CreateControlPointCurve([points[i], points[i+1]])
        travel_path_lines.append(line)
# ---------- end python ----------
geo = Geometry(python.travel_path_lines)
geo_2 = Geometry(python.print_path_pipes)
preview = CustomPreview(Geometry=geo_2, Material=ColourSwatch(SwatchColor=RGB(130, 130, 130)))
preview_2 = CustomPreview(Geometry=geo, Material=ColourSwatch(SwatchColor=RGB(255, 156, 36)))

# ----
pln = Plane(load_fabrication_commands.planes)
crv = Curve(load_fabrication_commands.continuous_path_polyline)
mesh = Mesh(load_slicer_data.mesh)
pt_2 = Point(load_slicer_data.all_points)
crv_2 = Curve(load_slicer_data.paths)

# ---- group: Visualize section of print path
dom_2 = ConstructDomain(DomainStart=Slider(0, range=0..100), DomainEnd=Slider(251, range=0..500))
subset_3 = SubList(List=pt, Domain=dom_2, Wrap=True)  # -> List, Index
pline = PolyLine(Vertices=subset_3.List, Closed=False)

# ---- group: Visualize printing parameters
# Select parameter to visualize
list_2 = ValueList({"Velocity": 0, "Radius": 1, "Wait time": 2, "Extruder toggle": 3}, selected="Extruder toggle")
filter_3 = StreamFilter(
    Gate=list_2,
    Stream0=load_fabrication_commands.velocity_list,
    Stream1=load_fabrication_commands.radius_list,
    Stream2=load_fabrication_commands.wait_time_list,
    Stream3=load_fabrication_commands.extruder_toggle_list)

# ----
curvepoint = PointOnCurve(crv_2, parameter=1)
disc = Discontinuity(Curve=crv_2, Level=1)  # -> Points, Parameters
end = EndPoints(Curve=crv_2)  # -> Start, End
item = ListItem(List=crv_2, Index=0, Wrap=True)
preview_3 = CustomPreview(Geometry=crv_2, Material=ColourSwatch(SwatchColor=RGB(189, 189, 189)))

# ---- group: Visualize with text
tag_offset = Slider(1, range=0..100)
pdecon = Deconstruct(Point=pt)  # -> XComponent, YComponent, ZComponent
addition = Addition(A=pdecon.ZComponent, B=tag_offset)
pt_3 = ConstructPoint(XCoordinate=pdecon.XComponent, YCoordinate=pdecon.YComponent, ZCoordinate=addition)
tag = TextTag(Location=pt_3, Text=filter_3, Colour=ColourSwatch(SwatchColor=RGB(50, 130, 186)))

# ---- group: Visualize in color
bnd = Bounds(Numbers=filter_3)
dedomain = DeconstructDomain(Domain=bnd)  # -> Start, End
gradient = Gradient(
    LowerLimit=dedomain.Start,
    UpperLimit=dedomain.End,
    Parameter=filter_3,
    stops=[0: RGB(0, 128, 0), 0.5: RGB(255, 255, 0), 1: RGB(255, 0, 0)])
pt_4 = Point(load_fabrication_commands.points)
cloud = CloudDisplay(Points=pt_4, Colours=gradient, Size=Slider(2.28, range=0..10), SpriteType=0)

# ----
number_slider = Slider(3, range=0..10)

# ---- group: Triangle mesh
input_mesh = Mesh(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)

# ----
contour = Contour(Shape=input_mesh, Point=Point(0, 0, 0), Direction=Vector(0, 0, 1), Distance=number_slider)

# ---- group: Layers
geo_3 = Geometry(flatten(contour))

# ----
# Save to json
# Enables loading ready - made paths in compas_slicer.
# You need to provide the gh_paths and the gh_mesh
panel_3 = Panel("paths_from_gh.json")
py_3 = PythonScript()  # -> path; same code as py
save_paths_to_json = GhPythonScript(
    recompute=Button(),
    gh_layers=geo_3,
    gh_mesh=input_mesh,
    gh_layer_height=number_slider,
    save_Json=Toggle(True),
    path=py_3,
    folder_name=data_folder_name,
    output_name=panel_3)  # -> out, paths, all_points, mesh; inputs gh_layers: list of Curve, gh_mesh: Mesh, save_Json: Boolean
# ---------- save_paths_to_json: Python ----------
import os
import json
import rhinoscriptsyntax as rs
import Rhino.Geometry as rg
from compas.datastructures import Mesh

def save_to_json(data, filepath, name):
    filename = os.path.join(filepath, name)
    print("Saving to json: " + filename)
    with open(filename, 'w') as f:
        f.write(json.dumps(data, indent=3, sort_keys=True))


data = {}

########## Export mesh
## Need to check that it is triangular 
vs = gh_mesh.Vertices
vs = [[float(v.X), float(v.Y), float(v.Z)]for v in vs]
fi = gh_mesh.Faces
fi = [[int(f.A), int(f.B), int(f.C)]for f in fi]

compas_mesh = Mesh.from_vertices_and_faces(vs,fi)
data['mesh'] = dict(compas_mesh.to_data())

########## Export paths
data['layers'] = {}
data['layer_height'] = gh_layer_height

for i, gh_layer in enumerate(gh_layers):
    data['layers']['layer_%d' % i] = {}
    data['layers']['layer_%d' % i]['path_0'] = {}
    data['layers']['layer_%d' % i]['path_0']['points'] = [[pt.X, pt.Y, pt.Z] for pt in rs.CurvePoints(gh_layer)]
    data['layers']['layer_%d' % i]['path_0']['is_closed'] = True
    
    
if save_Json:
    save_to_json(data, os.path.join(path, folder_name), output_name)
# ---------- end save_paths_to_json ----------
