# Grasshopper definition 2_basic_slicing_example.gh (Grasshopper 1.0.7)

# ---- group: Curves from Json
py = PythonScript()  # -> path
# ---------- py: Python ----------
import sys
import os

ghComp = ghenv.Component
ghDoc = ghComp.OnPingDocument()

# the full path of the gh file
path = ghDoc.FilePath
# the directory of the gh file
path = os.path.dirname(path)

#path = os.path.abspath(os.path.join(path, ".."))

print path
# ---------- end py ----------
python = GhPythonScript(recompute=Button(), path=py, name="bunny_low_res_stl_contours.json")  # -> out, curves, all_pts
# ---------- python: Python ----------
import os
import json
import rhinoscriptsyntax as rs
#import utils_compas as utils
#utils = reload(utils)

filename =os.path.join(os.path.join(path, "..") +'\data',name)

with open(filename, 'r') as f:
    data = json.load(f)
print("Loaded Json: " + filename)
    
curves = []
all_pts = []

for i in range(len(data)):
    print (i)
    pts = data[str(i)]
    polyline = rs.AddPolyline(pts)
    curves.append(polyline)
# ---------- end python ----------
pt = Point(python.all_pts)
crv = Curve(python.curves)

# ----
py_2 = PythonScript()  # -> path; same code as py
python_2 = GhPythonScript(recompute=Button(), path=py_2, name="bunny_low_res_stl_contours.json")  # -> out, curves, all_pts, polyline
# ---------- python_2: Python ----------
import os
import json
import rhinoscriptsyntax as rs
#import utils_compas as utils
#utils = reload(utils)

filename =os.path.join(os.path.join(path, "..") +'\data',name)

with open(filename, 'r') as f:
    data = json.load(f)
print("Loaded Json: " + filename)

curves = []
all_pts = []

"""
for i in range(len(data)):
    print (i)
    pts = data[str(i)]
    polyline = rs.AddPolyline(pts)
    curves.append(polyline)
"""

polyline = rs.AddPolyline(data)
# ---------- end python_2 ----------
crv_2 = Curve(python_2.polyline)
crv_3 = Curve(python_2.curves)
pt_2 = Point(python_2.all_pts)
disc = Discontinuity(Curve=crv_3, Level=1)  # -> Points, Parameters
preview = CustomPreview(Geometry=crv_3, Material=ColourSwatch(SwatchColor=RGB(189, 189, 189)))
preview_2 = CustomPreview(Geometry=crv, Material=ColourSwatch(SwatchColor=RGB(189, 189, 189)))
end = EndPoints(Curve=crv_3)  # -> Start, End
disc_2 = Discontinuity(Curve=crv, Level=1)  # -> Points, Parameters
end_2 = EndPoints(Curve=crv)  # -> Start, End
