# Grasshopper definition curved_slicing_master.gh (Grasshopper 1.0.7)

# ---- group: FOLDER
data_folder_name = Panel("data_advanced_example\")

data_folder_name_2 = Panel("data_basic_example\")

# ---- group: Selection
list = ValueList({"Basic example": 0, "Advanced example": 1}, selected="Basic example")

# ----
connection = Mesh(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)
vase = Mesh(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)
merge = Merge(Data1=flatten(data_folder_name_2), Data2=flatten(data_folder_name))
merge_2 = Merge(Data1=flatten(vase), Data2=flatten(connection))
item = ListItem(List=merge, Index=list, Wrap=True)
item_2 = ListItem(List=merge_2, Index=list, Wrap=True)

# ----
# Input
# Inputs
py = PythonScript()  # -> path
# ---------- py: Python ----------
import sys
import os

ghComp = ghenv.Component
ghDoc = ghComp.OnPingDocument()

# the full path of the gh file
path = ghDoc.FilePath
# the current directory 
path = os.path.abspath(os.path.join(path, ".."))

print path
# ---------- end py ----------

# ---- group: Folder name
data = Data(item)

# ---- group: Input mesh
mesh = Mesh(item_2)

# ----
# Output
# Load Slicer
button = Button()
panel = Panel("curved_slicer.json")
csfindfilenames = CsFindFilenames(recompute=button, starts_with="curved_slicer", ends_with=".json", path=py, folder_name=data)  # -> out, filenames, n; inputs recompute: Boolean
# ---------- csfindfilenames: Python ----------
"""
Finds all the filenames from the output directory that have the specified name. 

"""

import compas_slicer_ghpython.visualization as gh_compas_slicer
gh_compas_slicer = reload(gh_compas_slicer)
import os

if starts_with and ends_with and path and folder_name:
    filenames = gh_compas_slicer.get_files_with_name(starts_with, ends_with, os.path.join(path, folder_name, 'output'))
    n = len(filenames)
else:
    gh_compas_slicer.missing_input()
# ---------- end csfindfilenames ----------
csloadslicer = CsLoadSlicer(recompute=button, json_name=csfindfilenames.filenames, path=py, folder_name=data)  # -> out, mesh, paths, are_closed, all_points; inputs recompute: Boolean
# ---------- csloadslicer: Python ----------
"""
Loads a Slicer class from its json file in the 'output' folder.

"""

import compas_slicer_ghpython.visualization as gh_compas_slicer
gh_compas_slicer = reload(gh_compas_slicer)


if path and folder_name and json_name:
    mesh, paths, are_closed, all_points = gh_compas_slicer.load_slicer(path, folder_name, json_name)
else:
    gh_compas_slicer.missing_input()
# ---------- end csloadslicer ----------

# ----
# Load Printpoints
panel_2 = Panel("out_printpoints_flat")
panel_3 = Panel("out_printpoints_flat.json")
csfindfilenames_2 = CsFindFilenames(recompute=button, starts_with=panel_2, ends_with="json", path=py, folder_name=data)  # -> out, filenames, n; inputs recompute: Boolean; same code as csfindfilenames
csloadprintpoints = CsLoadPrintpoints(recompute=Button(), json_name=csfindfilenames_2.filenames, path=py, folder_name=data)  # -> out, geometry, points, frames, layer_heights, up_vectors, mesh_normals, closest_support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; inputs recompute: Boolean
# ---------- csloadprintpoints: Python ----------
"""
Loads a dictionaly of Printpoints from a json file in the 'output' folder.

"""

import compas_slicer_ghpython.visualization as gh_compas_slicer
gh_compas_slicer = reload(gh_compas_slicer)


if path and folder_name and json_name:
    points, frames, layer_heights, up_vectors, mesh_normals, closest_support, velocities, wait_times, \
    blend_radiuses, extruder_toggles = \
        gh_compas_slicer.load_printpoints(path, folder_name, json_name)
    
else:
    gh_compas_slicer.missing_input()
# ---------- end csloadprintpoints ----------

# ----
# Load Printpoints
panel_4 = Panel("out_printpoints_nested")
panel_5 = Panel("out_printpoints_nested.json")
load_frames = BooleanToggle(True)
load_layer_heights = BooleanToggle(True)
load_up_vectors = BooleanToggle(True)
load_normals = BooleanToggle(True)
load_closest_support_pt = BooleanToggle(False)
load_velocities = BooleanToggle(True)
load_wait_times = BooleanToggle(False)
load_blend_radiuses = BooleanToggle(False)
load_extruder_toggles = BooleanToggle(True)
csfindfilenames_3 = CsFindFilenames(recompute=button, starts_with=panel_4, ends_with=".json", path=py, folder_name=data)  # -> out, filenames, n; inputs recompute: Boolean; same code as csfindfilenames
csloadprintpoints_2 = CsLoadPrintpoints(
    recompute=Button(),
    json_name=csfindfilenames_3.filenames,
    path=py,
    folder_name=data,
    load_frames=load_frames,
    load_layer_heights=load_layer_heights,
    load_up_vectors=load_up_vectors,
    load_normals=load_normals,
    load_closest_support_pt=load_closest_support_pt,
    load_velocities=load_velocities,
    load_wait_times=load_wait_times,
    load_blend_radiuses=load_blend_radiuses,
    load_extruder_toggles=load_extruder_toggles)  # -> out, layers; inputs recompute: Boolean
# ---------- csloadprintpoints_2: Python ----------
"""
Loads a dictionaly of Printpoints from a json file in the 'output' folder.

"""

import compas_slicer_ghpython.visualization as gh_compas_slicer
gh_compas_slicer = reload(gh_compas_slicer)


if path and folder_name and json_name:
    layers = gh_compas_slicer.load_nested_printpoints(path, folder_name, json_name, load_frames, load_layer_heights, load_up_vectors,
                            load_normals, load_closest_support_pt, load_velocities, load_wait_times,
                            load_blend_radiuses, load_extruder_toggles)
    
else:
    gh_compas_slicer.missing_input()
# ---------- end csloadprintpoints_2 ----------

# ---- group: Path cross-section
# Visualization
xz = XZPlane(Origin=Point(0, 0, 0))
rectangle = Rectangle(Plane=xz, XSize=Slider(2.5, range=0..10), YSize=Slider(1, range=0..10), Radius=Slider(0.43, range=0..1))  # -> Rectangle, Length

# ----
mesh_2 = Mesh(mesh)
medges = MeshEdges(Mesh=mesh_2)  # -> NakedEdges, InteriorEdges, NonManifoldEdges

# ----
# Debugging
# Single distance list
button_2 = Button()
offset = Slider(47.4, range=0..200)
csloadjsondata = CsLoadJsonData(recompute=button_2, json_name="distances_LOW.json", path=py, folder_name=data)  # -> out, data; inputs recompute: Boolean
# ---------- csloadjsondata: Python ----------
"""Loads a json file from the output folder. """

import compas_slicer_ghpython.visualization as gh_compas_slicer
gh_compas_slicer = reload(gh_compas_slicer)

if json_name and path and folder_name:
    data = gh_compas_slicer.load_json_file(path, folder_name, json_name)
else:
    gh_compas_slicer.missing_input()
# ---------- end csloadjsondata ----------
bnd = Bounds(Numbers=csloadjsondata.data)
bounds = Panel(bnd)
olffset = GhPythonScript(values=csloadjsondata.data, offset=offset)  # -> a; inputs values: list
# ---------- olffset: Python ----------
a = [v-offset for v in values]
# ---------- end olffset ----------

join = JoinCurves(Curves=flatten(medges.NakedEdges), Preserve=False)

# ----
# Simple interpolation
panel_6 = Panel("distances_HIGH.json")
weight = Slider(0.5, range=0..1)
csinterpolation = CsInterpolation(recompute=Button(), json_name1="distances_LOW.json", json_name2=panel_6, weight=weight, path=py, folder_name=data)  # -> out, interpolation; inputs recompute: Boolean
# ---------- csinterpolation: Python ----------
"""
Interpolation of the two distance fields that are loaded from the 'output' folder. 

"""

import compas_slicer_ghpython.visualization as gh_compas_slicer
gh_compas_slicer = reload(gh_compas_slicer)

if json_name1 and json_name2 and path and folder_name:
    interpolation = gh_compas_slicer.distance_fields_interpolation(path, folder_name, json_name1, json_name2, weight)
else:
    gh_compas_slicer.missing_input()
# ---------- end csinterpolation ----------

item_3 = ListItem(List=flatten(join), Index=0, Wrap=True)  # -> Item, Item1, Item2, Item3
# Export boundary vertices to json
toggle = BooleanToggle(False)

crv = Curve(item_3.Item3)
mesh_3 = Mesh(mesh_2)
crv_2 = Curve([item_3.Item, item_3.Item1, item_3.Item2])

panel_7 = Panel(csloadprintpoints_2.out)

# ---- group: Visualization settings
layer_index_start = Slider(0, range=0..100)
pt_index_end = Slider(206, range=0..1000)
layer_index_end = Slider(14, range=1..100)

# ----
panel_8 = Panel(csloadslicer.out)

# ---- group: Visualization settings / true/false to display all/only selected printpoitns
display_all = BooleanToggle(False)

# ----
all_points = Point(csloadslicer.all_points)
mesh_4 = Mesh(csloadslicer.mesh)
paths = Curve(csloadslicer.paths)

panel_9 = Panel(csloadprintpoints.out)

points = Point(csloadprintpoints.points)
frames = Plane(csloadprintpoints.frames)
up_vectors = Vector(csloadprintpoints.up_vectors)
mesh_normals = Vector(csloadprintpoints.mesh_normals)
cpts = Point(csloadprintpoints.closest_support)
layer_heights = Number(csloadprintpoints.layer_heights)

frames_2 = Plane(frames)
pflip = FlipPlane(Plane=frames_2, ReverseX=False, ReverseY=False, SwapAxes=True)

print_planes = Plane(pflip)
tool_mesh = Mesh(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)

# ----
# Tool Visualization
# Note: This is only an example. The actual tool orientation depends on the definition of the frame of your tool
number_slider = Slider(1104, range=0..2000)
tool_origin = Panel("""0
0
99.507""")
cstoolviz = CsToolViz(origin_coords=tool_origin, mesh=tool_mesh, planes=print_planes, index=number_slider)  # -> out, mesh, passed_path; inputs origin_coords: list, mesh: Mesh, planes: list, index: Int32
# ---------- cstoolviz: Python ----------
"""
Example visualization of tool motion during the print.

"""

import compas_slicer_ghpython.visualization as gh_compas_slicer
gh_compas_slicer = reload(gh_compas_slicer)

if origin_coords and mesh and planes and (index or index==0):
    mesh, passed_path = gh_compas_slicer.tool_visualization(origin_coords, mesh, planes, index)
else:
    gh_compas_slicer.missing_input()
# ---------- end cstoolviz ----------

mesh_normals_2 = Vector(mesh_normals)
points_2 = Point(points)
section = Curve(rectangle.Rectangle)

velocities = Number(csloadprintpoints.velocities)
wait_times = Number(csloadprintpoints.wait_times)
blend_radiuses = Number(csloadprintpoints.blend_radiuses)
extruder_toggles = Number(csloadprintpoints.extruder_toggles)

# ----
# Ligthweight Path Visualization
number_slider_2 = Slider(3.9, range=0..10)
extruder_toggles_2 = Number(extruder_toggles)
all_points_2 = Point(points)
cslightpathviz = CsLightPathViz(
    points=all_points_2,
    extruder_toggles=extruder_toggles_2,
    domain_start=Slider(0, range=0..100),
    domain_end=Slider(1263, range=0..2000),
    pipe_diameter=number_slider_2)  # -> out, print_path_pipes, travel_path_lines; inputs points: list of Point3d, extruder_toggles: list of Boolean, domain_start: Int32, domain_end: Int32
# ---------- cslightpathviz: Python ----------
"""
Creates a lightweight visualization of the print paths. Segments with extruder_toggle=True are visualized as pipes, 
segments with extruder_toggle=False are visualized as lines.
Loads files from the 'output' folder.

"""

import compas_slicer_ghpython.visualization as gh_compas_slicer
gh_compas_slicer = reload(gh_compas_slicer)

pipe_resolution = 14

if points:
    
    # assign default values to parameters where possible. 
    if not extruder_toggles:
        extruder_toggles = [False for i in range(len(points))]
    if not domain_start:
        domain_start = 0
    if not domain_end:
        domain_end = len(points)
    if not pipe_diameter:
        pipe_diameter = 2.0
        
    print_path_pipes, travel_path_lines = \
        gh_compas_slicer.lightweight_path_visualization(points, extruder_toggles, pipe_diameter, pipe_resolution)
    
else:
    gh_compas_slicer.missing_input()
# ---------- end cslightpathviz ----------

# ----
# Render Path Visualization
toggle_2 = BooleanToggle(False)
extruder_toggles_3 = Number(extruder_toggles)
layer_heights_2 = Number(layer_heights)
up_vectors_2 = Vector(up_vectors)

python = CsRenderPathViz(
    points=points_2,
    mesh_normals=mesh_normals_2,
    layer_heights=layer_heights_2,
    up_vectors=up_vectors_2,
    extruder_toggles=extruder_toggles_3,
    cross_section=section,
    planar_printing=toggle_2,
    compute=Toggle(True))  # -> out, loft_surfaces, travel_path_lines; inputs points: list of Point3d, mesh_normals: list of Vector3d, layer_heights: list, up_vectors: list of Vector3d, extruder_toggles: list of Boolean, cross_section: Curve, planar_printing: Boolean, compute: Boolean
# ---------- python: Python ----------
"""
Creates a render visualization of the print paths with loft surfaces where extruder_toggle=True.
For large number of points, this can take a while to compute, so keep it turned off unless you need it.
Loads files from the 'output' folder.

"""

import compas_slicer_ghpython.visualization as gh_compas_slicer
gh_compas_slicer = reload(gh_compas_slicer)

pipe_resolution = 14

if points and mesh_normals and layer_heights and extruder_toggles and cross_section:
    if compute:
        loft_surfaces, travel_path_lines = \
            gh_compas_slicer.render_path_visualization(points, mesh_normals, layer_heights, up_vectors, extruder_toggles, cross_section, planar_printing)
    else:
        print('Compute is set to False')
else:
    gh_compas_slicer.missing_input()
# ---------- end python ----------
cstargetinput = CsTargetInput(compute=toggle, mesh=mesh_3, targets=flatten(crv_2), path=py, folder_name=data, json_name="boundaryHIGH.json")  # -> out, all_pts, target_vs, target_vi; inputs compute: Boolean, mesh: Mesh, targets: list of Curve
# ---------- cstargetinput: Python ----------
"""
Creates a json file with the specified targets' information, needed for curved slicing with compas_slicer.

"""

import compas_slicer_ghpython.visualization as gh_compas_slicer
gh_compas_slicer = reload(gh_compas_slicer)


if compute:
    if mesh and targets and path and folder_name and json_name:
        all_pts, target_vs, target_vi = \
        gh_compas_slicer.create_targets(mesh, targets, path, folder_name, json_name)
    else:
        gh_compas_slicer.missing_input()
else:
    print('Compute is set to False')
# ---------- end cstargetinput ----------
cstargetinput_2 = CsTargetInput(compute=toggle, mesh=mesh_3, targets=flatten(crv), path=py, folder_name=data, json_name="boundaryLOW.json")  # -> out, all_pts, target_vs, target_vi; inputs compute: Boolean, mesh: Mesh, targets: list of Curve
# ---------- cstargetinput_2: Python ----------
"""
Creates a json file with the specified targets' information, needed for curved slicing with compas_slicer.

"""

import compas_slicer_ghpython.visualization as gh_compas_slicer
gh_compas_slicer = reload(gh_compas_slicer)


if compute:
    if mesh and targets  and path and folder_name and json_name:
        all_pts, target_vs, target_vi = \
        gh_compas_slicer.create_targets(mesh, targets, path, folder_name, json_name)
    else:
        gh_compas_slicer.missing_input()
else:
    print('Compute is set to False')
# ---------- end cstargetinput_2 ----------

# ---- group: Color output
geo = Geometry(cslightpathviz.print_path_pipes)
geo_2 = Geometry(cslightpathviz.travel_path_lines)
preview = CustomPreview(Geometry=geo, Material=ColourSwatch(SwatchColor=RGB(199, 199, 199)))
preview_2 = CustomPreview(Geometry=geo_2, Material=ColourSwatch(SwatchColor=RGB(255, 156, 36)))

geo_3 = Geometry(python.travel_path_lines)
geo_4 = Geometry(python.loft_surfaces)
preview_3 = CustomPreview(Geometry=geo_4, Material=ColourSwatch(SwatchColor=RGB(222, 222, 222)))
preview_4 = CustomPreview(Geometry=geo_3, Material=ColourSwatch(SwatchColor=RGB(255, 156, 36)))

# ----
geo_5 = Geometry(cstoolviz.passed_path)
mesh_5 = Mesh(cstoolviz.mesh)
preview_5 = CustomPreview(Geometry=mesh_5, Material=ColourSwatch(SwatchColor=RGB(171, 171, 171)))
preview_6 = CustomPreview(Geometry=geo_5, Material=ColourSwatch(SwatchColor=RGB(255, 156, 36)))

# ----
# Visualize geodesic distances
distances = Number(olffset)
distances_2 = Number(csinterpolation.interpolation)

ln = Line(StartPoint=points, EndPoint=cpts)
vdis = VectorDisplay(Anchor=points, Vector=expr("x*5", up_vectors))
python_2 = GhPythonScript(
    layers=csloadprintpoints_2.layers,
    layer_index_start=layer_index_start,
    layer_index_end=layer_index_end,
    pt_index_end=pt_index_end,
    display_all=display_all)  # -> out, geometry, points, frames, layer_heights, up_vectors, mesh_normals, closest_support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; inputs layers: list, layer_index_start: Int32, layer_index_end: Int32, pt_index_end: Int32, display_all: Boolean
# ---------- python_2: Python ----------
"""
Visualizes PrintPoints information of compas_slicer paths.
"""

import compas_slicer_ghpython.visualization as gh_compas_slicer
gh_compas_slicer = reload(gh_compas_slicer)

points = []
frames = []
layer_heights = []
up_vectors = []
mesh_normals = []
closest_support = []

velocities = []
wait_times = []
blend_radiuses = []
extruder_toggles = []

if layer_index_start >= len(layers) - 2:
    layer_index_start = len(layers) -2
   
    
if layer_index_end >= len(layers):
    layer_index_end = len(layers)
    
if layer_index_start > layer_index_end:
    layer_index_start = layer_index_end
    
print('layer_index_start = ' + str(layer_index_start))
print('layer_index_end = ' + str(layer_index_end))
    

if len(layers) > 0:
    # display all
    if display_all:
        for layer in layers:
            for path in layer.paths:
                for ppt in path.ppts:
                    
                    points.append(ppt.pt)
                    frames.append(ppt.frame)
                    layer_heights.append(ppt.layer_height)
                    up_vectors.append(ppt.up_vector)
                    mesh_normals.append(ppt.mesh_normal)
                    closest_support.append(ppt.closest_support_pt)
                    
                    velocities.append(ppt.velocity)
                    wait_times.append(ppt.wait_time)
                    blend_radiuses.append(ppt.blend_radius)
                    extruder_toggles.append(ppt.extruder_toggle)
        
    else:
        # display selection
        for i, layer in enumerate(layers[layer_index_start:layer_index_end]):
            if i < layer_index_end-layer_index_start -1:
                # fully displayed layers
                for path in layer.paths:
                    for ppt in path.ppts:
                        points.append(ppt.pt)
                        frames.append(ppt.frame)
                        layer_heights.append(ppt.layer_height)
                        up_vectors.append(ppt.up_vector)
                        mesh_normals.append(ppt.mesh_normal)
                        closest_support.append(ppt.closest_support_pt)
                        
                        velocities.append(ppt.velocity)
                        wait_times.append(ppt.wait_time)
                        blend_radiuses.append(ppt.blend_radius)
                        extruder_toggles.append(ppt.extruder_toggle)
            else:
                # partly displayed layers (using pt_index_end)
                count = 0
                for path in layer.paths:
                    for ppt in path.ppts:
                        if count < pt_index_end:
                            points.append(ppt.pt)
                            frames.append(ppt.frame)
                            layer_heights.append(ppt.layer_height)
                            up_vectors.append(ppt.up_vector)
                            mesh_normals.append(ppt.mesh_normal)
                            closest_support.append(ppt.closest_support_pt)
                            
                            velocities.append(ppt.velocity)
                            wait_times.append(ppt.wait_time)
                            blend_radiuses.append(ppt.blend_radius)
                            extruder_toggles.append(ppt.extruder_toggle)
                            
                            count += 1
# ---------- end python_2 ----------
pt = Point(cstargetinput.target_vs)
pt_2 = Point(cstargetinput_2.target_vs)
abs = Absolute(Value=distances_2)

# ---- group: Select parameter
num = Number(layer_heights)

# ---- group: Visualize distance values on mesh
distances_3 = Number(abs)
mesh_6 = Mesh(mesh)

# ---- group: Visualize parameter with text
tag_offset = Slider(1, range=0..100)
pdecon = Deconstruct(Point=points)  # -> XComponent, YComponent, ZComponent
addition = Addition(A=pdecon.ZComponent, B=tag_offset)
pt_3 = ConstructPoint(XCoordinate=pdecon.XComponent, YCoordinate=pdecon.YComponent, ZCoordinate=addition)
tag = TextTag(Location=pt_3, Text=num, Colour=ColourSwatch(SwatchColor=RGB(50, 130, 186)))

# ---- group: Visualize parameter with color
bnd_2 = Bounds(Numbers=num)
avr = Average(Input=num)
dedomain = DeconstructDomain(Domain=bnd_2)  # -> Start, End
average = Panel(avr)
gradient = Gradient(
    LowerLimit=dedomain.Start,
    UpperLimit=dedomain.End,
    Parameter=num,
    stops=[0: RGB(0, 128, 0), 0.5: RGB(255, 255, 0), 1: RGB(255, 0, 0)])
pt_4 = Point(points)
cloud = CloudDisplay(Points=pt_4, Colours=gradient, Size=Slider(1.72, range=0..10), SpriteType=1)

# ---- group: Visualize distance values on mesh
bnd_3 = Bounds(Numbers=distances_3)
dedomain_2 = DeconstructDomain(Domain=bnd_3)  # -> Start, End
gradient_2 = Gradient(
    LowerLimit=dedomain_2.Start,
    UpperLimit=dedomain_2.End,
    Parameter=distances_3,
    stops=[0: RGB(0, 128, 0), 0.0566: RGB(255, 255, 0), 0.915: RGB(255, 0, 0)])
demesh = DeconstructMesh(Mesh=mesh_6)  # -> Vertices, Faces, Colours, Normals
conmesh = ConstructMesh(Vertices=demesh.Vertices, Faces=demesh.Faces, Colours=gradient_2)

# ---- group: Slicer data
len = Length(Curve=flatten(paths))
lng = ListLength(List=flatten(paths))
sum = GhPythonScript(x=len)  # -> out, a; inputs x: list
# ---------- sum: Python ----------
__author__ = "Ioanna"
__version__ = "2020.10.25"

import rhinoscriptsyntax as rs

a = 0
for v in x:
    a += v
# ---------- end sum ----------
total_path_length = Panel(sum.a)
total_number_of_paths = Panel(lng)

# ----
panel_10 = Panel(python_2.out)

points_3 = Point(python_2.points)
layer_heights_3 = Number(python_2.layer_heights)
up_vectors_3 = Vector(python_2.up_vectors)
mesh_normals_3 = Vector(python_2.mesh_normals)
cpts_2 = Point(python_2.closest_support)
frames_3 = Plane(python_2.frames)

velocities_2 = Number(python_2.velocities)
extruder_toggles_4 = Number(python_2.extruder_toggles)
wait_times_2 = Number(python_2.wait_times)
blend_radiuses_2 = Number(python_2.blend_radiuses)

min = Panel(dedomain.Start)
max = Panel(dedomain.End)
vdis_2 = VectorDisplay(Anchor=points_3, Vector=expr("x*5", up_vectors_3))
pline = PolyLine(Vertices=points_3, Closed=False)
num_2 = Number(velocities_2)

# ---- group: Visualize parameter with color
bnd_4 = Bounds(Numbers=num_2)
avr_2 = Average(Input=num_2)
dedomain_3 = DeconstructDomain(Domain=bnd_4)  # -> Start, End
average_2 = Panel(avr_2)
gradient_3 = Gradient(
    LowerLimit=dedomain_3.Start,
    UpperLimit=dedomain_3.End,
    Parameter=num_2,
    stops=[0: RGB(0, 128, 0), 0.5: RGB(255, 255, 0), 1: RGB(255, 0, 0)])
pt_5 = Point()
cloud_2 = CloudDisplay(Points=pt_5, Colours=gradient_3, Size=Slider(1, range=0..10), SpriteType=0)

# ---- group: Visualize parameter with text
tag_offset_2 = Slider(1, range=0..100)
pdecon_2 = Deconstruct(Point=points_3)  # -> XComponent, YComponent, ZComponent
addition_2 = Addition(A=pdecon_2.ZComponent, B=tag_offset_2)
pt_6 = ConstructPoint(XCoordinate=pdecon_2.XComponent, YCoordinate=pdecon_2.YComponent, ZCoordinate=addition_2)
tag_2 = TextTag(Location=pt_6, Text=num_2, Colour=ColourSwatch(SwatchColor=RGB(50, 130, 186)))

# ----
# Load Vectors
panel_11 = Panel("gradient.json")
csloadjsonvectors = CsLoadJsonVectors(recompute=Button(), json_name=panel_11, path=py, folder_name=data)  # -> out, vectors; inputs recompute: Boolean
# ---------- csloadjsonvectors: Python ----------
"""
Loads a json file from the 'output' folder, 
that stores a vector field in the format: 
data['0']=[x0,y0,z0], ...,  data['N']=[xN,yN,zN]


"""

import compas_slicer_ghpython.visualization as gh_compas_slicer
gh_compas_slicer = reload(gh_compas_slicer)

if json_name and path and folder_name:
    vectors = gh_compas_slicer.load_json_vectors(path, folder_name, json_name)
else:
    gh_compas_slicer.missing_input()
# ---------- end csloadjsonvectors ----------
demesh_2 = DeconstructMesh(Mesh=mesh)  # -> Vertices, Faces, Colours, Normals
vdis_3 = VectorDisplay(Anchor=demesh_2.Vertices, Vector=csloadjsonvectors.vectors)

# ----
# Load Points
button_3 = Button()
csloadjsonpoints = CsLoadJsonPoints(recompute=button_3, json_name="pts_boundary_HIGH_0.json", path=py, folder_name=data)  # -> out, points; inputs recompute: Boolean
# ---------- csloadjsonpoints: Python ----------
"""
Loads a json file that stores a dictionary of N points in the format: 
data['0']=[x0,y0,z0], ...,  data['N']=[xN,yN,zN]


"""

import compas_slicer_ghpython.visualization as gh_compas_slicer
gh_compas_slicer = reload(gh_compas_slicer)

if json_name and path and folder_name:
    points = gh_compas_slicer.load_json_points(path, folder_name, json_name)
else:
    gh_compas_slicer.missing_input()
# ---------- end csloadjsonpoints ----------
pt_7 = Point(csloadjsonpoints.points)

min_2 = Panel(dedomain_3.Start)
max_2 = Panel(dedomain_3.End)

# ----
# Find files by name
button_4 = Button()
csfindfilenames_4 = CsFindFilenames(recompute=button_4, starts_with="curved_slicer_", ends_with=".json", path=py, folder_name=data)  # -> out, filenames, n; inputs recompute: Boolean; same code as csfindfilenames
filenames = Panel(csfindfilenames_4.filenames)
number_of_files = Panel(csfindfilenames_4.n)

# ----
# Load Polylines
button_5 = Button()

csloadjsonpolylines = CsLoadJsonPolylines(recompute=button_5, json_name="point_clusters_polylines_0.json", path=py, folder_name=data)  # -> out, polylines, points; inputs recompute: Boolean
# ---------- csloadjsonpolylines: Python ----------
"""
Loads a json file that stores a dictionary of N polylines in the format:
data['0']=points_dict_0, ..., data['N'] = points_dict_N, where points_dict is in the format:
points_dict['0']=[x0,y0,z0], ...,  points_dict['N']=[xN,yN,zN]


"""

import compas_slicer_ghpython.visualization as gh_compas_slicer
gh_compas_slicer = reload(gh_compas_slicer)

if json_name and path and folder_name:
    polylines, points = gh_compas_slicer.load_json_polylines(path, folder_name, json_name)
else:
    gh_compas_slicer.missing_input()
# ---------- end csloadjsonpolylines ----------

crv_3 = Curve(csloadjsonpolylines.polylines)

# ----
# Load BaseBoundaries
button_6 = Button()

csloadjsonboundary = CsLoadJsonBoundary(recompute=button_6, path=py, folder_name=data)  # -> out, points, vectors, n; inputs recompute: Boolean
# ---------- csloadjsonboundary: Python ----------
"""
Loads a json file that stores a dictionary of BaseBoundary classes in the format:
data['0']=base_boundary_1.to_data(), ..., data['N']=base_boundary_N.to_data()


"""

import compas_slicer_ghpython.visualization as gh_compas_slicer
gh_compas_slicer = reload(gh_compas_slicer)

if json_name and path and folder_name:
    points, vectors, n = gh_compas_slicer.load_base_boundaries(path, folder_name, json_name)
else:
    gh_compas_slicer.missing_input()
# ---------- end csloadjsonboundary ----------

no_of_boundaries = Panel(csloadjsonboundary.n)
vdis_4 = VectorDisplay(Anchor=csloadjsonboundary.points, Vector=expr("x*3", csloadjsonboundary.vectors))

# ----
# Load Data
# Gradient norm
panel_12 = Panel("gradient_norm.json")
mesh_7 = Mesh(mesh)
demesh_3 = DeconstructMesh(Mesh=mesh_7)  # -> Vertices, Faces, Colours, Normals

csloadjsondata_2 = CsLoadJsonData(recompute=Button(), json_name=panel_12, path=py, folder_name=data)  # -> out, data; inputs recompute: Boolean; same code as csloadjsondata

data_2 = Data(csloadjsondata_2.data)
bnd_5 = Bounds(Numbers=data_2)
gradient_4 = Gradient(
    LowerLimit=Slider(0.1, range=0..0.1),
    UpperLimit=Slider(1, range=0..1),
    Parameter=data_2,
    stops=[0: RGB(234, 38, 0), 0.25: RGB(234, 126, 0), 0.5: RGB(254, 244, 84), 0.75: RGB(173, 203, 249), 1: RGB(75, 107, 169)])
avr_3 = Average(Input=data_2)
dedomain_4 = DeconstructDomain(Domain=bnd_5)  # -> Start, End
max_3 = Panel(dedomain_4.End)
min_3 = Panel(dedomain_4.Start)
average_3 = Panel(avr_3)
conmesh_2 = ConstructMesh(Vertices=demesh_3.Vertices, Faces=demesh_3.Faces, Colours=gradient_4)

# ----
# Load Data
# Load vertex indices
panel_13 = Panel("minima.json")
number_slider_3 = Slider(5.7, range=0..20)
demesh_4 = DeconstructMesh(Mesh=mesh)  # -> Vertices, Faces, Colours, Normals
merge_3 = Merge(Data1=panel_13, Data2="maxima.json", Data3="saddles.json")

csloadjsondata_3 = CsLoadJsonData(recompute=Button(), json_name=merge_3, path=py, folder_name=data)  # -> out, simplify(data); inputs recompute: Boolean; same code as csloadjsondata

branch = TreeBranch(Tree=csloadjsondata_3.data, Path="0", MaintainPaths=True)
branch_2 = TreeBranch(Tree=csloadjsondata_3.data, Path="1", MaintainPaths=True)
branch_3 = TreeBranch(Tree=csloadjsondata_3.data, Path="2", MaintainPaths=True)
item_4 = ListItem(List=demesh_4.Vertices, Index=branch, Wrap=True)
item_5 = ListItem(List=demesh_4.Vertices, Index=branch_2, Wrap=True)
item_6 = ListItem(List=demesh_4.Vertices, Index=branch_3, Wrap=True)
cloud_3 = CloudDisplay(Points=item_4, Colours=ColourSwatch(SwatchColor=RGB(107, 235, 52)), Size=number_slider_3, SpriteType=1)
cloud_4 = CloudDisplay(Points=item_5, Colours=ColourSwatch(SwatchColor=RGB(235, 52, 52)), Size=number_slider_3, SpriteType=1)
cloud_5 = CloudDisplay(Points=item_6, Colours=ColourSwatch(SwatchColor=RGB(18, 18, 18)), Size=number_slider_3, SpriteType=1)

# ----
# Load multiple meshes by name
button_7 = Button()

csloadmeshesbyname = CsLoadMeshesByName(recompute=button_7, starts_with="split_mesh_", ends_with=".obj", path=py, folder_name=data)  # -> out, loaded_meshes, number_of_meshes; inputs recompute: Boolean
# ---------- csloadmeshesbyname: Python ----------
"""
Loads all the meshes from the output directory that have the specified filename, and displays them with color.

"""

import compas_slicer_ghpython.visualization as gh_compas_slicer
gh_compas_slicer = reload(gh_compas_slicer)

if starts_with and ends_with and path and folder_name:
    loaded_meshes = gh_compas_slicer.load_multiple_meshes(starts_with, ends_with, path, folder_name)
    number_of_meshes = len(loaded_meshes)
else:
    gh_compas_slicer.missing_input()
# ---------- end csloadmeshesbyname ----------
mesh_8 = Mesh(csloadmeshesbyname.loaded_meshes)

medges_2 = MeshEdges(Mesh=csloadmeshesbyname.loaded_meshes)  # -> NakedEdges, InteriorEdges, NonManifoldEdges
number_of_meshes = Panel(csloadmeshesbyname.number_of_meshes)
crv_4 = Curve(medges_2.NakedEdges)
