# Grasshopper definition visualization.gh (Grasshopper 1.0.7)

py = PythonScript()  # -> path
# ---------- py: Python ----------
import sys
import os

ghComp = ghenv.Component
ghDoc = ghComp.OnPingDocument()

# the full path of the gh file
path = ghDoc.FilePath
# the current directory 
path = os.path.abspath(os.path.join(path, ".."))

print path
# ---------- end py ----------
slicer_data = GhPythonScript(recompute=Button(), path=py, folder="data", name="fabrication_commands.json")  # -> out, points, planes, continuous_path_polyline, velocity_list, radius_list, wait_time_list, extruder_toggle_list
# ---------- slicer_data: Python ----------
import os
import json
import rhinoscriptsyntax as rs

filename =os.path.join(os.path.join(path), folder ,name)
print(filename)

# load data from json
with open(filename, 'r') as f:
    data = json.load(f)
print("Loaded Json: " + filename)

points = []
planes = []
velocity_list = []
radius_list = []
wait_time_list = []
extruder_toggle_list = []

for i in range(len(data)):
    data_point = data[str(i)]
    x = data_point["x"]
    y = data_point["y"]
    z = data_point["z"]
    ax = data_point["ax"]
    ay = data_point["ay"]
    az = data_point["az"]
    velocity = data_point["velocity"]
    radius = data_point["radius"]
    wait_time = data_point["wait_time"]
    extruder_toggle = data_point["extruder_toggle"]
    
    # re-create points
    point = rs.AddPoint(x, y, z)
    points.append(point)
    
    # re-create planes
    # not sure if planes are in the correct orientation?
    plane = rs.PlaneFromNormal(point, (ax, ay, az))
    planes.append(plane)
    
    velocity_list.append(velocity)
    radius_list.append(radius)
    wait_time_list.append(wait_time)
    extruder_toggle_list.append(extruder_toggle)

# create full polyline
continuous_path_polyline = rs.AddPolyline(points)
# ---------- end slicer_data ----------
pt = Point(slicer_data.points)
pln = Plane(slicer_data.planes)
crv = Curve(slicer_data.continuous_path_polyline)

# ---- group: Visualize printing parameters
# Select parameter to visualize
list = ValueList({"Velocity": 0, "Radius": 1, "Wait time": 2, "Extruder toggle": 3}, selected="Velocity")
tag_offset = Slider(1, range=0..100)
pdecon = Deconstruct(Point=pt)  # -> XComponent, YComponent, ZComponent
filter = StreamFilter(
    Gate=list,
    Stream0=slicer_data.velocity_list,
    Stream1=slicer_data.radius_list,
    Stream2=slicer_data.wait_time_list,
    Stream3=slicer_data.extruder_toggle_list)
addition = Addition(A=pdecon.ZComponent, B=tag_offset)
pt_2 = ConstructPoint(XCoordinate=pdecon.XComponent, YCoordinate=pdecon.YComponent, ZCoordinate=addition)
tag = TextTag(Location=pt_2, Text=filter, Colour=ColourSwatch(SwatchColor=RGB(50, 130, 186)))

# ---- group: Visualize section of print path
dom = ConstructDomain(DomainStart=Slider(0, range=0..100), DomainEnd=Slider(251, range=0..500))
subset = SubList(List=pt, Domain=dom, Wrap=True)  # -> List, Index
pline = PolyLine(Vertices=subset.List, Closed=False)
