# Grasshopper definition visualization.gh (Grasshopper 1.0.7)

# ---- group: Paths collection from Json
py = PythonScript()  # -> path
# ---------- py: Python ----------
import sys
import os

ghComp = ghenv.Component
ghDoc = ghComp.OnPingDocument()

# the full path of the gh file
path = ghDoc.FilePath
# the directory of the gh file
path = os.path.dirname(path)

#path = os.path.abspath(os.path.join(path, ".."))

print path
# ---------- end py ----------
printorganizer = GhPythonScript(recompute=Button(), path=py, folder="data", name="print_organizer.json")  # -> out, printOrganizer
# ---------- printorganizer: Python ----------
import os
import json
import Rhino.Geometry as rg

class PrintOrganizer:
    def __init__(self):
        self.printpoints = []
        
class PrintPoint:
    def __init__(self, data):
        self.pt = rg.Point3d(data["point"][0], data["point"][1], data["point"][2])
        
        self.closest_support_pt = None
        if data["closest_support_pt"]:
            self.closest_support_pt = rg.Point3d(data["closest_support_pt"][0], data["closest_support_pt"][1], data["closest_support_pt"][2])
        
        if data["distance_to_support"]:
            self.distance_to_support = data["distance_to_support"]
            
        self.closest_upper_point = None
        if data["closest_upper_point"]:
            self.closest_upper_point = rg.Point3d(data["closest_upper_point"][0], data["closest_upper_point"][1], data["closest_upper_point"][2])
            
        if data["up_vector"]:
            self.up_vector = rg.Vector3d(data["up_vector"][0], data["up_vector"][1], data["up_vector"][2])
        
        if data["layer_height"]:
            self.layer_height = data["layer_height"]
            
        if data["frame"]:
            self.frame = rg.Plane(rg.Point3d(data["frame"]["point"][0], data["frame"]["point"][1],data["frame"]["point"][2]), 
                                 rg.Vector3d(data["frame"]["xaxis"][0], data["frame"]["xaxis"][1],data["frame"]["xaxis"][2]),
                                 rg.Vector3d(data["frame"]["yaxis"][0], data["frame"]["yaxis"][1],data["frame"]["yaxis"][2]))
        
        if data["mesh_normal"]:
            self.mesh_normal = rg.Vector3d(data["mesh_normal"][0], data["mesh_normal"][1], data["mesh_normal"][2])
        
        
###############
### load data
###############

filename = os.path.join(path, folder ,name)
print (filename)

with open(filename, 'r') as f:
    data = json.load(f)

printOrganizer = PrintOrganizer()

if 'printpoints' in data:
    for pp_key in data['printpoints']:
        printpoint = PrintPoint(data['printpoints'][pp_key])
        printOrganizer.printpoints.append(printpoint)
# ---------- end printorganizer ----------

# ----
py_2 = PythonScript()  # -> path
# ---------- py_2: Python ----------
import sys
import os

ghComp = ghenv.Component
ghDoc = ghComp.OnPingDocument()

# the full path of the gh file
path = ghDoc.FilePath
# the current directory 
path = os.path.abspath(os.path.join(path, ".."))

print path
# ---------- end py_2 ----------
slicer = GhPythonScript(recompute=Button(), path=py_2, folder="data", name="curved_slicer.json")  # -> out, slicer
# ---------- slicer: Python ----------
import os
import json
import rhinoscriptsyntax as rs
from compas.datastructures import Mesh

filename =os.path.join(os.path.join(path), folder ,name)
print(filename)

class Slicer:
    def __init__(self):
        self.flattened_path = None
        self.flattened_path_pts = []
        self.layers = []
        self.mesh = None

# load data from json
with open(filename, 'r') as f:
    data = json.load(f)
print("Loaded Json: " + filename)

slicer = Slicer()

flattened_path_points = []
if 'flattened_path' in data:
    flattened_path_dict = data['flattened_path']
    print('found flattened paths')
    
    for i in range(len(flattened_path_dict)):
        pt = flattened_path_dict[str(i)]
        pt_gh = rs.AddPoint(pt[0], pt[1], pt[2])
        flattened_path_points.append(pt_gh)
    slicer.flattened_path_pts = flattened_path_points
    slicer.flattened_path = rs.AddPolyline(flattened_path_points)
    
#if 'layers' in data:
#    layers_dict = data['layers']
#    print('found layers')
#    for key in layers_dict: 
#        for pt in layers_dict[key]:
#        print(layers_dict[key])
    
#if 'mesh' in data:
#    mesh_dict = data['mesh']
#    print('found mesh')
#    mesh = Mesh.from_data(mesh_dict)
# ---------- end slicer ----------

py_3 = PythonScript()  # -> path; same code as py_2
slicer_data = GhPythonScript(recompute=Button(), path=py_3, folder="data", name="slicer_data_layers1.json")  # -> out, paths, points, mesh
# ---------- slicer_data: Python ----------
import os
import json
import rhinoscriptsyntax as rs
from compas.datastructures import Mesh

filename =os.path.join(os.path.join(path), folder ,name)
print(filename)

# load data from json
with open(filename, 'r') as f:
    data = json.load(f)
print("Loaded Json: " + filename)

paths = []
points = []

if 'mesh' in data:
    mesh = Mesh.from_data(data['mesh'])
    ## find how to turn Compas Mesh to Rhino mesh
    
if 'layers' in data:
    layers = data['layers']

    for i in range(len(layers)):
        layer = layers[str(i)]
        for j in range(len(layer)):
            path = layer[str(j)]
            pts = []
            
            for k in range(len(path)):
                pt = path[str(k)]
                # re-create points
                pt = rs.AddPoint(pt[0], pt[1], pt[2])
                pts.append(pt)
            points.extend(pts)
            
            # create contour per layer
            path = rs.AddPolyline(pts)
            paths.append(path)
# ---------- end slicer_data ----------

python = GhPythonScript(printOrganizer=printorganizer.printOrganizer)  # -> out, points, closest_support_pts, distance_to_supports, closest_upper_points, up_vectors, mesh_normals, frames, layer_heights
# ---------- python: Python ----------
__author__ = "Ioanna"
__version__ = "2020.05.19"

import rhinoscriptsyntax as rs

points = []
closest_support_pts = []
distance_to_supports = []
closest_upper_points = []
up_vectors = []
layer_heights = []
frames = []
mesh_normals = []

print('%d printpoints' % len(printOrganizer.printpoints))

for printpoint in printOrganizer.printpoints:
    print(printpoint.pt)
    points.append(printpoint.pt)
    closest_support_pts.append(printpoint.closest_support_pt)
    distance_to_supports.append(printpoint.distance_to_support)
    closest_upper_points.append(printpoint.closest_upper_point)
    up_vectors.append(printpoint.up_vector)
    layer_heights.append(printpoint.layer_height)
    frames.append(printpoint.frame)
    mesh_normals.append(printpoint.mesh_normal)
# ---------- end python ----------
python_2 = GhPythonScript(slicer=slicer.slicer)  # -> out, flattened_path_polyline, flattened_path_pts
# ---------- python_2: Python ----------
__author__ = "Ioanna"
__version__ = "2020.09.09"

import rhinoscriptsyntax as rs

flattened_path_polyline = slicer.flattened_path
flattened_path_pts = slicer.flattened_path_pts
# ---------- end python_2 ----------
pt = Point(slicer_data.points)
crv = Curve(slicer_data.paths)
curvepoint = PointOnCurve(crv, parameter=1)
pt_2 = Point(python.points)
disc = Discontinuity(Curve=crv, Level=1)  # -> Points, Parameters
end = EndPoints(Curve=crv)  # -> Start, End
pt_3 = Point(slicer.slicer)
crv_2 = Curve()
preview = CustomPreview(Geometry=crv, Material=ColourSwatch(SwatchColor=RGB(189, 189, 189)))
panel = Panel(python.out)
ln = Line(StartPoint=pt_2, EndPoint=python.closest_support_pts)
pln = Plane(python.frames)
vdis = VectorDisplay(Anchor=pt_2, Vector=python.up_vectors)
data = Data(python.layer_heights)
preview_2 = CustomPreview(Geometry=crv_2, Material=ColourSwatch(SwatchColor=RGB(189, 189, 189)))

# ---- group: distance to support
bnd = Bounds(Numbers=data)
dedomain = DeconstructDomain(Domain=bnd)  # -> Start, End
gradient = Gradient(
    LowerLimit=dedomain.Start,
    UpperLimit=dedomain.End,
    Parameter=data,
    stops=[0: RGB(0, 128, 0), 0.5: RGB(255, 255, 0), 1: RGB(255, 0, 0)])
cloud = CloudDisplay(Points=pt_2, Colours=gradient, Size=1, SpriteType=0)

# ---- group: layer height
avr = Average(Input=python.layer_heights)
bnd_2 = Bounds(Numbers=python.layer_heights)
panel_2 = Panel(avr)
panel_3 = Panel(bnd_2)
