# Grasshopper definition visualization.gh (Grasshopper 1.0.7)

# ---- group: Select sliced mesh
path = FilePath("C:\Users\joburger\Documents\Projects\compas_slicer\examples\7_planar_slicing_cgal\data\branches_70.stl")

# ---- group: Print point
pt = Point(<point referenced from the Rhino model>)

# ----
py = PythonScript()  # -> path
# ---------- py: Python ----------
import sys
import os

ghComp = ghenv.Component
ghDoc = ghComp.OnPingDocument()

# the full path of the gh file
path = ghDoc.FilePath
# the current directory 
path = os.path.abspath(os.path.join(path, ".."))

print path
# ---------- end py ----------
slicer_data = GhPythonScript(recompute=Button(), path=py, folder="data", name="slicer_data.json")  # -> out, contours, points, continuous_path_polyline
# ---------- slicer_data: Python ----------
import os
import json
import rhinoscriptsyntax as rs

filename =os.path.join(os.path.join(path), folder ,name)
print(filename)

# load data from json
with open(filename, 'r') as f:
    data = json.load(f)
print("Loaded Json: " + filename)

contours = []
points = []

if 'contours' in data:
    contours_dict = data['contours']

for i in range(len(contours_dict)):
    print (i)
    pts = contours_dict[str(i)]
    for pt in pts:
        
        # re-create points
        pt = rs.AddPoint(pt[0], pt[1], pt[2])
        points.append(pt)
        
    # create contour per layer
    try:
        contour = rs.AddPolyline(pts)
        contours.append(contour)
    except:
        pass

# create full polyline
continuous_path_polyline = rs.AddPolyline(points)
# ---------- end slicer_data ----------

py_2 = PythonScript()  # -> path; same code as py
python = GhPythonScript(mesh_path=path)  # -> out, pt
# ---------- python: Python ----------
__author__ = "joburger"
__version__ = "2020.07.17"

import Rhino.Geometry as rg

import compas_slicer.positioning.get_mid_pt_base as get_mid_pt_base
import imp
imp.reload(get_mid_pt_base)

from compas.datastructures import Mesh

mesh = Mesh.from_stl(mesh_path)

pt = get_mid_pt_base.get_mid_pt_base(mesh)

pt = rg.Point3d(pt[0], pt[1], pt[2])
# ---------- end python ----------
panel = Panel(path)
slicer_data_2 = GhPythonScript(recompute=Button(), path=py_2, folder="data", name="slicer_data_layers.json")  # -> out, points, contours, layers, continuous_path_polyline
# ---------- slicer_data_2: Python ----------
import os
import json
import rhinoscriptsyntax as rs

filename =os.path.join(os.path.join(path), folder ,name)
print(filename)

# load data from json
with open(filename, 'r') as f:
    data = json.load(f)
print("Loaded Json: " + filename)

layers = []
contours = []
points = []

for layer in data:
    pts_per_layer = []
    for contour in layer:
        contour_polyline = rs.AddPolyline(contour)
        contours.append(contour_polyline)
        for point in contour:
            pt = rs.AddPoint(point[0], point[1], point[2])
            points.append(pt)
            pts_per_layer.append(pt)
    layer_polyline = rs.AddPolyline(pts_per_layer)
    layers.append(layer_polyline)

continuous_path_polyline = rs.AddPolyline(points)

print("Sliced model consists out of:")
print(str(len(layers)) + " layers")
print(str(len(contours)) + " contours")
print(str(len(points)) + " points")
# ---------- end slicer_data_2 ----------
pt_2 = Point(slicer_data_2.points)
crv = Curve(slicer_data_2.contours)
crv_2 = Curve(slicer_data_2.layers)
crv_3 = Curve(slicer_data_2.continuous_path_polyline)
crv_4 = Curve(slicer_data.contours)
pt_3 = Point(slicer_data.points)
crv_5 = Curve(slicer_data.continuous_path_polyline)
orient = Orient(Geometry=pt_2, Source=python.pt, Target=pt)  # -> Geometry, Transform
preview = CustomPreview(Geometry=crv, Material=ColourSwatch(SwatchColor=RGB(189, 189, 189)))
disc = Discontinuity(Curve=crv_4, Level=1)  # -> Points, Parameters
end = EndPoints(Curve=crv_4)  # -> Start, End
preview_2 = CustomPreview(Geometry=crv_4, Material=ColourSwatch(SwatchColor=RGB(189, 189, 189)))
pt_4 = Point(orient.Geometry)
