# Grasshopper definition visualization.gh (Grasshopper 1.0.7)

py = PythonScript()  # -> path
# ---------- py: Python ----------
import sys
import os

ghComp = ghenv.Component
ghDoc = ghComp.OnPingDocument()

# the full path of the gh file
path = ghDoc.FilePath
# the current directory 
path = os.path.abspath(os.path.join(path, ".."))

print path
# ---------- end py ----------
slicer_data = GhPythonScript(recompute=Button(), path=py, folder="data", name="fabrication_commands.json")  # -> out, points, continuous_path_polyline
# ---------- slicer_data: Python ----------
import os
import json
import rhinoscriptsyntax as rs

filename =os.path.join(os.path.join(path), folder ,name)
print(filename)

# load data from json
with open(filename, 'r') as f:
    data = json.load(f)
print("Loaded Json: " + filename)

print(data["154"])

points = []

for i in range(len(data)):
    pt = data[str(i)]
    print(pt)
        
    # re-create points
    point = rs.AddPoint(pt[0], pt[1], pt[2])
    points.append(point)

# create full polyline
continuous_path_polyline = rs.AddPolyline(points)
# ---------- end slicer_data ----------
crv = Curve(slicer_data.continuous_path_polyline)
pt = Point(slicer_data.points)
