# Grasshopper definition visualization.gh (Grasshopper 1.0.7)

py = PythonScript()  # -> path
# ---------- py: Python ----------
import sys
import os

ghComp = ghenv.Component
ghDoc = ghComp.OnPingDocument()

# the full path of the gh file
path = ghDoc.FilePath
# the current directory 
path = os.path.abspath(os.path.join(path, ".."))

print path
# ---------- end py ----------
slicer_data = GhPythonScript(recompute=Button(), path=py, folder="data", name="fabrication_commands.json")  # -> out, points, continuous_path_polyline
# ---------- slicer_data: Python ----------
import os
import json
import rhinoscriptsyntax as rs

filename =os.path.join(os.path.join(path), folder ,name)
print(filename)

# load data from json
with open(filename, 'r') as f:
    data = json.load(f)
print("Loaded Json: " + filename)

points = []

for i in range(len(data)):
    data_point = data[str(i)]
    point = data_point["pt"]
    
        
    # re-create points
    point = rs.AddPoint(point[0], point[1], point[2])
    points.append(point)

# create full polyline
continuous_path_polyline = rs.AddPolyline(points)
# ---------- end slicer_data ----------
crv = Curve(slicer_data.continuous_path_polyline)
pt = Point(slicer_data.points)
dom = ConstructDomain(DomainStart=Slider(0, range=0..100), DomainEnd=Slider(100, range=0..100))
subset = SubList(List=pt, Domain=dom, Wrap=True)  # -> List, Index
pline = PolyLine(Vertices=subset.List, Closed=False)
