# Grasshopper definition visualization.gh (Grasshopper 1.0.7)

data_folder_name = Panel("data")

# ----
# Visualize robotic commands
panel = Panel("fabrication_commands.json")
py = PythonScript()  # -> path
# ---------- py: Python ----------
import sys
import os

ghComp = ghenv.Component
ghDoc = ghComp.OnPingDocument()

# the full path of the gh file
path = ghDoc.FilePath
# the current directory 
path = os.path.abspath(os.path.join(path, ".."))

print path
# ---------- end py ----------
slicer_data = GhPythonScript(recompute=Button(), path=py, folder_name=data_folder_name, name=panel)  # -> out, points, planes, continuous_path_polyline, velocity_list, radius_list, wait_time_list, extruder_toggle_list
# ---------- slicer_data: Python ----------
import os
import json
import rhinoscriptsyntax as rs

filename =os.path.join(os.path.join(path), folder_name ,name)
print(filename)

# load data from json
with open(filename, 'r') as f:
    data = json.load(f)
print("Loaded Json: " + filename)

points = []
planes = []
velocity_list = []
radius_list = []
wait_time_list = []
extruder_toggle_list = []

for i in range(len(data)):
    data_point = data[str(i)]
    x = data_point["x"]
    y = data_point["y"]
    z = data_point["z"]
    ax = data_point["ax"]
    ay = data_point["ay"]
    az = data_point["az"]
    velocity = data_point["velocity"]
    radius = data_point["radius"]
    wait_time = data_point["wait_time"]
    extruder_toggle = data_point["extruder_toggle"]
    
    # re-create points
    point = rs.AddPoint(x, y, z)
    points.append(point)
    
    # re-create planes
    # not sure if planes are in the correct orientation?
    plane = rs.PlaneFromNormal(point, (ax, ay, az))
    planes.append(plane)
    
    velocity_list.append(velocity)
    radius_list.append(radius)
    wait_time_list.append(wait_time)
    extruder_toggle_list.append(extruder_toggle)

# create full polyline
continuous_path_polyline = rs.AddPolyline(points)
# ---------- end slicer_data ----------

# ----
# Visualize slicer
panel_2 = Panel("slicer_data.json")
py_2 = PythonScript()  # -> path; same code as py
slicer_data_2 = GhPythonScript(recompute=Button(), path=py_2, folder_name=data_folder_name, name=panel_2)  # -> out, paths, all_points, mesh
# ---------- slicer_data_2: Python ----------
import os
import json
import rhinoscriptsyntax as rs
from compas.datastructures import Mesh

filename =os.path.join(os.path.join(path), folder_name ,name)
print(filename)

# load data from json
with open(filename, 'r') as f:
    data = json.load(f)
print("Loaded Json: " + filename)

paths = []
all_points = []

if 'mesh' in data:
    mesh = Mesh.from_data(data['mesh'])
    ## find how to turn Compas Mesh to Rhino mesh
    
if 'layers' in data:
    layers = data['layers']

    for i in range(len(layers)):
        layer = layers[str(i)]
        for j in range(len(layer)):
            path_data = layer[str(j)]
            pts = []

            for k in range(len(path_data['points'])):
                pt = path_data['points'][str(k)]
                # re-create points
                pt = rs.AddPoint(pt[0], pt[1], pt[2])
                pts.append(pt)
            all_points.extend(pts)
            
            # create contour per layer
            path = rs.AddPolyline(pts)
            paths.append(path)
# ---------- end slicer_data_2 ----------

pln = Plane(slicer_data.planes)
pt = Point(slicer_data.points)
crv = Curve(slicer_data.continuous_path_polyline)
pt_2 = Point(slicer_data_2.all_points)
crv_2 = Curve(slicer_data_2.paths)

# ---- group: Visualize section of print path
dom = ConstructDomain(DomainStart=Slider(0, range=0..100), DomainEnd=Slider(251, range=0..500))
subset = SubList(List=pt, Domain=dom, Wrap=True)  # -> List, Index
pline = PolyLine(Vertices=subset.List, Closed=False)

# ---- group: Visualize printing parameters
# Select parameter to visualize
list = ValueList({"Velocity": 0, "Radius": 1, "Wait time": 2, "Extruder toggle": 3}, selected="Velocity")
tag_offset = Slider(1, range=0..100)
pdecon = Deconstruct(Point=pt)  # -> XComponent, YComponent, ZComponent
filter = StreamFilter(
    Gate=list,
    Stream0=slicer_data.velocity_list,
    Stream1=slicer_data.radius_list,
    Stream2=slicer_data.wait_time_list,
    Stream3=slicer_data.extruder_toggle_list)
addition = Addition(A=pdecon.ZComponent, B=tag_offset)
pt_3 = ConstructPoint(XCoordinate=pdecon.XComponent, YCoordinate=pdecon.YComponent, ZCoordinate=addition)
tag = TextTag(Location=pt_3, Text=filter, Colour=ColourSwatch(SwatchColor=RGB(50, 130, 186)))

# ----
curvepoint = PointOnCurve(crv_2, parameter=1)
disc = Discontinuity(Curve=crv_2, Level=1)  # -> Points, Parameters
end = EndPoints(Curve=crv_2)  # -> Start, End
item = ListItem(List=crv_2, Index=0, Wrap=True)
preview = CustomPreview(Geometry=crv_2, Material=ColourSwatch(SwatchColor=RGB(189, 189, 189)))

# ----
# Visualize slicer
panel_3 = Panel("slicer_data.json")
py_3 = PythonScript()  # -> path; same code as py
slicer_data_3 = GhPythonScript(recompute=Button(), path=py_3, folder_name=data_folder_name, name=panel_3)  # -> out, paths, all_points, mesh
# ---------- slicer_data_3: Python ----------
import os
import json
import rhinoscriptsyntax as rs
from compas.datastructures import Mesh
import Rhino.Geometry as rg


filename =os.path.join(os.path.join(path), folder_name ,name)
print(filename)

# load data from json
with open(filename, 'r') as f:
    data = json.load(f)
print("Loaded Json: " + filename)


out_points = []
for i in range(len(data)):
    points = data[str(i)]
    if i==0:
        [points_out.append(rg.Point3d(p[0], p[1], p[2])) for p in points]
# ---------- end slicer_data_3 ----------
