# Grasshopper definition surface.gh (Grasshopper 1.0.7)

py = PythonScript()  # -> path
# ---------- py: Python ----------
import sys
import os

ghComp = ghenv.Component
ghDoc = ghComp.OnPingDocument()

# the full path of the gh file
path = ghDoc.FilePath
# the current directory 
path = os.path.abspath(os.path.join(path, ".."))

print path
# ---------- end py ----------
python = GhPythonScript(recompute=Button(), path=py, folder="data", name="curved_slicer.json")  # -> out, contours, points, polyline
# ---------- python: Python ----------
import os
import json
import rhinoscriptsyntax as rs

filename =os.path.join(os.path.join(path), folder ,name)
print(filename)

# load data from json
with open(filename, 'r') as f:
    data = json.load(f)
print("Loaded Json: " + filename)

contours = []
points = []

if 'contours' in data:
    contours_dict = data['contours']

for i in range(len(contours_dict)):
    print (i)
    pts = contours_dict[str(i)]
    for pt in pts:
        # re-create points
        pt = rs.AddPoint(pt[0], pt[1], pt[2])
        points.append(pt)
    # create contour per layer
    contour = rs.AddPolyline(pts)
    contours.append(contour)

# create full polyline
polyline = rs.AddPolyline(points)
# ---------- end python ----------
crv = Curve(python.contours)
pt = Point(python.points)
crv_2 = Curve(python.polyline)
disc = Discontinuity(Curve=crv, Level=1)  # -> Points, Parameters
end = EndPoints(Curve=crv)  # -> Start, End
preview = CustomPreview(Geometry=crv, Material=ColourSwatch(SwatchColor=RGB(189, 189, 189)))
