# Grasshopper definition 2_basic_slicing_example.gh (Grasshopper 1.0.7)

py = PythonScript()  # -> path
# ---------- py: Python ----------
import sys
import os

ghComp = ghenv.Component
ghDoc = ghComp.OnPingDocument()

# the full path of the gh file
path = ghDoc.FilePath
# the compas_am directory
path = os.path.abspath(os.path.join(path, "..", "..", ".."))

print path
# ---------- end py ----------
python = GhPythonScript(recompute=Button(), path=py, name="branches_70_contours.json")  # -> out, contours, points, polyline
# ---------- python: Python ----------
import os
import json
import rhinoscriptsyntax as rs

filename =os.path.join(os.path.join(path) +'\data',name)
print(filename)

# load data from json
with open(filename, 'r') as f:
    data = json.load(f)
print("Loaded Json: " + filename)

contours = []
points = []

for i in range(len(data)):
    print (i)
    pts = data[str(i)]
    for pt in pts:
        # re-create points
        pt = rs.AddPoint(pt[0], pt[1], pt[2])
        points.append(pt)
    # create contour per layer
    contour = rs.AddPolyline(pts)
    contours.append(contour)

# create full polyline
polyline = rs.AddPolyline(points)
# ---------- end python ----------

# ---- group: visualise printing path
dom = ConstructDomain(DomainStart=Slider(0, range=0..1000), DomainEnd=Slider(928, range=0..1000))
subset = SubList(List=python.points, Domain=dom, Wrap=True)  # -> List, Index
pline = PolyLine(Vertices=subset.List, Closed=False)

# ----
crv = Curve(python.contours)
pt = Point(python.points)
crv_2 = Curve(python.polyline)
disc = Discontinuity(Curve=crv, Level=1)  # -> Points, Parameters
end = EndPoints(Curve=crv)  # -> Start, End
preview = CustomPreview(Geometry=crv, Material=ColourSwatch(SwatchColor=RGB(189, 189, 189)))
series = Series(Start=Slider(1, range=0..1), Step=1, Count=Slider(30, range=0..100))
item = ListItem(List=crv, Index=series, Wrap=True)
loft = Loft(Curves=item, Options={Adjust=False, Closed=False, LoftEnds=0, LoftSimp=0, LoftType=0, Rebuild=10, Refit=0.01})
