# Grasshopper definition visualization_master.gh (Grasshopper 1.0.7)

data_folder_name = Panel("data")

# ---- group: Path cross-section
xz = XZPlane(Origin=Point(0, 0, 0))
rectangle = Rectangle(Plane=xz, XSize=Slider(2.5, range=0..10), YSize=Slider(1, range=0..10), Radius=Slider(0.43, range=0..1))  # -> Rectangle, Length

# ---- group: Cutting shape
crv = Curve(<curve referenced from the Rhino model>)
Z = UnitZ(Factor=Slider(245, range=0..1000))
extr = Extrude(Base=crv, Direction=Z)
cap = CapHoles(Brep=extr)

# ----
Z_2 = UnitZ(Factor=1)

# ----
# Robotic commands
# Visualize robotic commands and their parameters
panel = Panel("fabrication_commands.json")
py = PythonScript()  # -> path
# ---------- py: Python ----------
import sys
import os

ghComp = ghenv.Component
ghDoc = ghComp.OnPingDocument()

# the full path of the gh file
path = ghDoc.FilePath
# the current directory 
path = os.path.abspath(os.path.join(path, ".."))

print path
# ---------- end py ----------
load_fabrication_commands = GhPythonScript(recompute=Button(), path=py, folder_name=data_folder_name, name=panel)  # -> out, points, print_frames, planes, continuous_path_polyline, velocity_list, radius_list, wait_time_list, extruder_toggle_list
# ---------- load_fabrication_commands: Python ----------
import os
import json
import rhinoscriptsyntax as rs
import Rhino.Geometry as rg
from compas.geometry import Frame

filename =os.path.join(os.path.join(path), folder_name ,name)
print(filename)

# load data from json
with open(filename, 'r') as f:
    data = json.load(f)
print("Loaded Json: " + filename)

points = []
print_frames = []
planes = []
velocity_list = []
radius_list = []
wait_time_list = []
extruder_toggle_list = []

for i in range(len(data)):
    data_point = data[str(i)]
    x = data_point["x"]
    y = data_point["y"]
    z = data_point["z"]
    ax = data_point["ax"]
    ay = data_point["ay"]
    az = data_point["az"]
    pl = data_point['plane']
    velocity = data_point["velocity"]
    radius = data_point["radius"]
    wait_time = data_point["wait_time"]
    extruder_toggle = data_point["extruder_toggle"]
    
    # re-create points
    point = rs.AddPoint(x, y, z)
    points.append(point)
    
    # re-create planes
    plane_point = pl['point']
    x_axis = pl['xaxis']
    y_axis = pl['yaxis']
    planes.append(rs.PlaneFromNormal(plane_point, rs.VectorCrossProduct(rg.Vector3d(x_axis[0], x_axis[1], x_axis[2]), rg.Vector3d(y_axis[0], y_axis[1], y_axis[2]))))
    
    
    # re-create print_frames
    # not sure if planes are in the correct orientation?
    compas_frame = Frame.from_axis_angle_vector([ax, ay, az], [x,y,z])
    cp = compas_frame.point
    x_axis = compas_frame.xaxis
    y_axis = compas_frame.yaxis
    print_frame = rs.PlaneFromNormal(point, rs.VectorCrossProduct(rg.Vector3d(x_axis[0], x_axis[1], x_axis[2]), rg.Vector3d(y_axis[0], y_axis[1], y_axis[2])))
    print_frames.append(print_frame)
    
    velocity_list.append(velocity)
    radius_list.append(radius)
    wait_time_list.append(wait_time)
    extruder_toggle_list.append(extruder_toggle)

# create full polyline
continuous_path_polyline = rs.AddPolyline(points)
# ---------- end load_fabrication_commands ----------

# ----
# Slicer
# Visualize paths and mesh of slicer
# MERGE SLICER AND ROBOTIC COMMANDS
panel_2 = Panel("slicer_data.json")
py_2 = PythonScript()  # -> path; same code as py
load_slicer_data = GhPythonScript(recompute=Button(), path=py_2, folder_name=data_folder_name, name=panel_2)  # -> out, paths, all_points, mesh, layer_height
# ---------- load_slicer_data: Python ----------
import os
import json
import rhinoscriptsyntax as rs
from compas.datastructures import Mesh
import Rhino.Geometry as rg

filename =os.path.join(os.path.join(path), folder_name ,name)
print(filename)

# load data from json
with open(filename, 'r') as f:
    data = json.load(f)
print("Loaded Json: " + filename)

paths = []
all_points = []

if 'mesh' in data:
    compas_mesh = Mesh.from_data(data['mesh'])
    vs, fi = compas_mesh.to_vertices_and_faces()
    mesh = rg.Mesh()
    for f in fi:
        gh_face = rg.MeshFace(f[0], f[1], f[2])
        mesh.Faces.AddFace(gh_face)
    for v in vs:
        pt = rg.Point3d(v[0], v[1], v[2])
        mesh.Vertices.Add(pt)

    
if 'layers' in data:
    layers = data['layers']

    for i in range(len(layers)):
        layer = layers[str(i)]
        for j in range(len(layer)):
            path_data = layer[str(j)]
            pts = []

            for k in range(len(path_data['points'])):
                pt = path_data['points'][str(k)]
                # re-create points
                pt = rs.AddPoint(pt[0], pt[1], pt[2])
                pts.append(pt)
            all_points.extend(pts)
            
            # create contour per layer
            path = rs.AddPolyline(pts)
            paths.append(path)
            
    layer_height = data['layer_height']
# ---------- end load_slicer_data ----------

# ---- group: layer height
num = Number(load_slicer_data.layer_height)

# ----
multiplication = Multiplication(A=num, B=Slider(0.9, range=0..1))
X = UnitX(Factor=1)
Z_3 = UnitZ(Factor=1)

crv_2 = Curve(load_fabrication_commands.continuous_path_polyline)
pt = Point(load_fabrication_commands.points)
pln = Plane(load_fabrication_commands.print_frames)
pln_2 = Plane(load_fabrication_commands.planes)

# ---- group: planes
pln_3 = Plane(pln_2)

# ----
# Heavy path visualization
deplane = DeconstructPlane(Plane=pln_3)  # -> Origin, XAxis, YAxis, ZAxis

# ---- group: Visualize mesh printing path
# Ligthweight path visualization
list = ValueList({"Visualize full path": 0, "Visualize part of path (set domain)": 1}, selected="Visualize full path")
nozzle_diameter = Slider(1.5, range=0..10)
sgements_resolution = Slider(14, range=0..20)
dom = ConstructDomain(DomainStart=Slider(0, range=0..100), DomainEnd=Slider(439, range=0..500))
subset = SubList(List=pt, Domain=dom, Wrap=True)  # -> List, Index
subset_2 = SubList(List=load_fabrication_commands.extruder_toggle_list, Domain=dom, Wrap=True)  # -> List, Index
filter = StreamFilter(Gate=list, Stream0=pt, Stream1=subset.List)
filter_2 = StreamFilter(Gate=list, Stream0=load_fabrication_commands.extruder_toggle_list, Stream1=subset_2.List)
python = GhPythonScript(points=filter, extruder_toggle_list=filter_2, nozzle_diameter=nozzle_diameter, segments=sgements_resolution)  # -> out, print_path_pipes, travel_path_lines; inputs points: list of Point3d, extruder_toggle_list: list
# ---------- python: Python ----------
__author__ = "joburger"
__version__ = "2020.10.12"

import Rhino.Geometry as rg

print_path_pipes = []
travel_path_lines = []

for i in range(len(points)-1):
    if extruder_toggle_list[i] == True:
        # if extruder_toggle is true, create line
        line = rg.Curve.CreateControlPointCurve([points[i], points[i+1]])
        # create meshpipe and append
        pipe = rg.Mesh.CreateFromCurvePipe(line, nozzle_diameter/2, segments, 1, rg.MeshPipeCapStyle.None, True)
        print_path_pipes.append(pipe)
    else:
        # if extruder_toggle is false, add to travel path list
        line = rg.Curve.CreateControlPointCurve([points[i], points[i+1]])
        travel_path_lines.append(line)
# ---------- end python ----------
geo = Geometry(python.travel_path_lines)
geo_2 = Geometry(python.print_path_pipes)
preview = CustomPreview(Geometry=geo_2, Material=ColourSwatch(SwatchColor=RGB(130, 130, 130)))
preview_2 = CustomPreview(Geometry=geo, Material=ColourSwatch(SwatchColor=RGB(255, 156, 36)))

# ---- group: up vector
up_vector = UnitVector(Vector=deplane.YAxis)

# ----
section = Curve(rectangle.Rectangle)
mesh = Mesh(load_slicer_data.mesh)
points = Point(deplane.Origin)

# ---- group: mesh normals
facen = FaceNormals(Mesh=mesh)  # -> Centers, Normals
meshcp = MeshClosestPoint(Point=points, Mesh=mesh)  # -> Point, Index, Parameter
item = ListItem(List=facen.Normals, Index=meshcp.Index, Wrap=True)
xy = XYPlane(Origin=Point(0, 0, 0))
unit = UnitVector(Vector=item)
project = Project(Geometry=unit, Plane=xy)  # -> Geometry, Transform

# ---- group: Customize section
section_2 = Curve(section)
area = Area(Geometry=section_2)  # -> Area, Centroid
scale_nu = ScaleNU(Geometry=section_2, Plane=area.Centroid, ScaleX=multiplication, ScaleY=1, ScaleZ=multiplication)  # -> Geometry, Transform

# ----
pl = ConstructPlane(Origin=area.Centroid, XAxis=X, YAxis=Z_3)

num_2 = Number(load_slicer_data.layer_height)
crv_3 = Curve(load_slicer_data.paths)
pt_2 = Point(load_slicer_data.all_points)
mesh_2 = Mesh(load_slicer_data.mesh)

# ---- group: Visualize section of print path
dom_2 = ConstructDomain(DomainStart=Slider(0, range=0..100), DomainEnd=Slider(251, range=0..500))
subset_3 = SubList(List=pt, Domain=dom_2, Wrap=True)  # -> List, Index
pline = PolyLine(Vertices=subset_3.List, Closed=False)

# ---- group: Visualize printing parameters
# Select parameter to visualize
list_2 = ValueList({"Velocity": 0, "Radius": 1, "Wait time": 2, "Extruder toggle": 3}, selected="Extruder toggle")
filter_3 = StreamFilter(
    Gate=list_2,
    Stream0=load_fabrication_commands.velocity_list,
    Stream1=load_fabrication_commands.radius_list,
    Stream2=load_fabrication_commands.wait_time_list,
    Stream3=load_fabrication_commands.extruder_toggle_list)

# ----
pl_2 = ConstructPlane(Origin=points, XAxis=project.Geometry, YAxis=up_vector)
orient = Orient(Geometry=scale_nu.Geometry, Source=pl, Target=pl_2)  # -> flatten(Geometry), Transform
shift = ShiftList(List=orient.Geometry, Shift=1, Wrap=False)  # -> graft(List)
curvepoint = PointOnCurve(crv_3, parameter=1)
disc = Discontinuity(Curve=crv_3, Level=1)  # -> Points, Parameters
end = EndPoints(Curve=crv_3)  # -> Start, End
item_2 = ListItem(List=crv_3, Index=0, Wrap=True)
preview_3 = CustomPreview(Geometry=crv_3, Material=ColourSwatch(SwatchColor=RGB(189, 189, 189)))
data = Data(simplify(graft(orient.Geometry)))
data_2 = Data(simplify(graft(shift)))
loft = Loft(Curves=[data, data_2], Options={Adjust=False, Closed=False, LoftEnds=0, LoftSimp=0, LoftType=0, Rebuild=10, Refit=0.01})  # -> flatten(Loft)
null = NullItem(Item=loft)  # -> NullFlags, InvalidFlags, Description

# ---- group: Visualize with text
tag_offset = Slider(1, range=0..100)
pdecon = Deconstruct(Point=pt)  # -> XComponent, YComponent, ZComponent
addition = Addition(A=pdecon.ZComponent, B=tag_offset)
pt_3 = ConstructPoint(XCoordinate=pdecon.XComponent, YCoordinate=pdecon.YComponent, ZCoordinate=addition)
tag = TextTag(Location=pt_3, Text=filter_3, Colour=ColourSwatch(SwatchColor=RGB(50, 130, 186)))

# ---- group: Visualize in color
bnd = Bounds(Numbers=filter_3)
dedomain = DeconstructDomain(Domain=bnd)  # -> Start, End
gradient = Gradient(
    LowerLimit=dedomain.Start,
    UpperLimit=dedomain.End,
    Parameter=filter_3,
    stops=[0: RGB(0, 128, 0), 0.5: RGB(255, 255, 0), 1: RGB(255, 0, 0)])
pt_4 = Point(load_fabrication_commands.points)
cloud = CloudDisplay(Points=pt_4, Colours=gradient, Size=Slider(2.28, range=0..10), SpriteType=0)

# ----
dispatch = Dispatch(List=loft, DispatchPattern=null.NullFlags)  # -> ListA, ListB

brep = Brep(dispatch.ListB)

swatch = ColourSwatch(SwatchColor=RGB(176, 176, 176))
preview_4 = CustomPreview(Geometry=brep, Material=swatch)
number_slider = Slider(91, range=0..1000)
number_slider_2 = Slider(3, range=0..10)

# ---- group: Triangle mesh
input_mesh = Mesh(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)

# ----
print_planes = Plane(pln)
# Tool Visualization
# Note: Correct print orientation will be defined from printing test
tool_mesh = Mesh(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)

contour = Contour(Shape=input_mesh, Point=Point(0, 0, 0), Direction=Vector(0, 0, 1), Distance=number_slider_2)

# ---- group: Layers
geo_3 = Geometry(flatten(contour))

# ----
deplane_2 = DeconstructPlane(Plane=print_planes)  # -> Origin, XAxis, YAxis, ZAxis
tool_origin_only_for_visualization = Panel("""0.153792
-0.01069
-0.045507""")

# ----
# Save to json
# Enables loading ready - made paths in compas_slicer.
# You need to provide the gh_paths and the gh_mesh
panel_3 = Panel("paths_from_gh.json")
py_3 = PythonScript()  # -> path; same code as py
save_paths_to_json = GhPythonScript(
    recompute=Button(),
    gh_layers=geo_3,
    gh_mesh=input_mesh,
    gh_layer_height=number_slider_2,
    save_Json=Toggle(True),
    path=py_3,
    folder_name=data_folder_name,
    output_name=panel_3)  # -> out, paths, all_points, mesh; inputs gh_layers: list of Curve, gh_mesh: Mesh, save_Json: Boolean
# ---------- save_paths_to_json: Python ----------
import os
import json
import rhinoscriptsyntax as rs
import Rhino.Geometry as rg
from compas.datastructures import Mesh

def save_to_json(data, filepath, name):
    filename = os.path.join(filepath, name)
    print("Saving to json: " + filename)
    with open(filename, 'w') as f:
        f.write(json.dumps(data, indent=3, sort_keys=True))


data = {}

########## Export mesh
## Need to check that it is triangular 
vs = gh_mesh.Vertices
vs = [[float(v.X), float(v.Y), float(v.Z)]for v in vs]
fi = gh_mesh.Faces
fi = [[int(f.A), int(f.B), int(f.C)]for f in fi]

compas_mesh = Mesh.from_vertices_and_faces(vs,fi)
data['mesh'] = dict(compas_mesh.to_data())

########## Export paths
data['layers'] = {}
data['layer_height'] = gh_layer_height

for i, gh_layer in enumerate(gh_layers):
    data['layers']['layer_%d' % i] = {}
    data['layers']['layer_%d' % i]['path_0'] = {}
    data['layers']['layer_%d' % i]['path_0']['points'] = [[pt.X, pt.Y, pt.Z] for pt in rs.CurvePoints(gh_layer)]
    data['layers']['layer_%d' % i]['path_0']['is_closed'] = True
    
    
if save_Json:
    save_to_json(data, os.path.join(path, folder_name), output_name)
# ---------- end save_paths_to_json ----------

# ---- group: tool visualization
# Tool visualization
button = Button()
python_2 = PythonScript(recompute=button, origin_coords=tool_origin_only_for_visualization, mesh=tool_mesh, planes=print_planes, i=number_slider)  # -> tool, mesh; inputs origin_coords: list, mesh: Mesh, planes: list of Plane, i: Int32
# ---------- python_2: Python ----------
import os
from compas.geometry import Frame
from compas.datastructures import Mesh
from compas_ghpython.artists import MeshArtist

import Rhino.Geometry as rg
import rhinoscriptsyntax as rs

origin = [float(origin_coords[0]), float(origin_coords[1]) , float(origin_coords[2])]
o = rg.Point3d(origin[0], origin[1], origin[2])
xaxis = [1, 0, 0]
x = rg.Vector3d(1, 0, 0)
yaxis = [0, 1, 0]
y = rg.Vector3d(0, 1, 0)

ee_frame = rg.Plane(o,x,y)
target_frame = planes[i]

T = rg.Transform.PlaneToPlane(ee_frame, target_frame)
S = rg.Transform.Scale(target_frame, 1000, 1000, 1000)

#rs.CopyObject(mesh)
mesh = rs.TransformObject(rs.CopyObject(mesh), T)
mesh = rs.TransformObject(rs.CopyObject(mesh), S)
# ---------- end python_2 ----------
mesh_3 = Mesh(python_2.mesh)
preview_5 = CustomPreview(Geometry=mesh_3, Material=ColourSwatch(SwatchColor=RGB(171, 171, 171)))

# ---- group: Path visualization
series = Series(Start=0, Step=1, Count=expr("x+1", number_slider))
item_3 = ListItem(List=deplane_2.Origin, Index=series, Wrap=True)
pline_2 = PolyLine(Vertices=item_3, Closed=False)

# ---- group: Cut to display object section
cap_2 = CapHoles(Brep=dispatch.ListB)  # disabled
cutter = Geometry(cap)  # disabled

# ----
null_2 = NullItem(Item=cap_2)  # -> NullFlags, InvalidFlags, Description; disabled
dispatch_2 = Dispatch(List=cap_2, DispatchPattern=null_2.NullFlags)  # -> ListA, ListB; disabled

# ---- group: Cut to display object section (continued)
sdiff = SolidDifference(BrepsA=flatten(dispatch_2.ListB), BrepsB=cutter)  # disabled
cap_3 = CapHoles(Brep=sdiff)  # disabled
shapein = ShapeInBrep(Brep=cutter, Shape=cap_3)  # disabled
dispatch_3 = Dispatch(List=sdiff, DispatchPattern=shapein)  # -> ListA, ListB; disabled

# ---- group: Sections
mesh_4 = Mesh(dispatch_3.ListA)  # disabled
mesh_5 = Mesh(dispatch_3.ListB)  # disabled

# ----
preview_6 = CustomPreview(Geometry=mesh_4, Material=swatch)  # disabled
